# Dynamo graph Supplementary File 1_Script_Pave_List.dyn (Dynamo 3.3.1.7726)
# packages: Civil3DToolkit 1.1.30

corridors = CorridorNameDropDown()  # nothing selected; graph input
choose_corridor_name = ListCorridorName("TRAMO_TEST", ItemList=["TRAMO_TEST"])  # graph input
baseline_name = StringInput("BASELINE_1")  # graph input
baseline_exist_yes_or_no = Python(IN[0]=choose_corridor_name, IN[1]=baseline_name)  # CPython3; graph output
# ---------- baseline_exist_yes_or_no.python (104 lines) ----------
# IN[0] = CorridorName (string)
# IN[1] = BaselineName (string)

import clr

def to_clean_string(x):
    if x is None:
        return ""
    return str(x).strip()

def result(ok, msg, validated=None, original=None):
    return (ok, msg, validated, original)

corridor_name = to_clean_string(IN[0])
baseline_name_original = "" if IN[1] is None else str(IN[1])  # echo EXACT original (no strip)
baseline_name_check = to_clean_string(IN[1])                  # used for validation (trimmed)

# ---------- Input validation ----------
if corridor_name == "":
    OUT = result(False, "ERROR: CorridorName is empty.", None, baseline_name_original)
    raise SystemExit

if baseline_name_check == "":
    OUT = result(False, "ERROR: BaselineName is empty.", None, baseline_name_original)
    raise SystemExit

try:
    clr.AddReference("AcMgd")
    clr.AddReference("AcDbMgd")
    clr.AddReference("AeccDbMgd")

    from Autodesk.AutoCAD.ApplicationServices import Application
    from Autodesk.AutoCAD.DatabaseServices import OpenMode
    import Autodesk.Civil.ApplicationServices as civApp

    doc = Application.DocumentManager.MdiActiveDocument
    db = doc.Database
    civil_doc = civApp.CivilApplication.ActiveDocument

    exists = False

    with doc.LockDocument():
        tr = db.TransactionManager.StartTransaction()
        try:
            corridor = None
            for cid in civil_doc.CorridorCollection:
                cor = tr.GetObject(cid, OpenMode.ForRead)
                if cor.Name == corridor_name:
                    corridor = cor
                    break

            if corridor is None:
                OUT = result(
                    False,
                    "ERROR: Corridor '{}' was not found.".format(corridor_name),
                    None,
                    baseline_name_original
                )
                tr.Commit()
                raise SystemExit

            if corridor.Baselines.Count == 0:
                OUT = result(
                    False,
                    "ERROR: Corridor '{}' contains no baselines.".format(corridor_name),
                    None,
                    baseline_name_original
                )
                tr.Commit()
                raise SystemExit

            for bl in corridor.Baselines:
                if bl.Name == baseline_name_check:
                    exists = True
                    break

            if exists:
                OUT = result(
                    True,
                    "OK: Baseline '{}' exists in corridor '{}'.".format(baseline_name_check, corridor_name),
                    baseline_name_check,
                    baseline_name_original
                )
            else:
                OUT = result(
                    False,
                    "ERROR: Baseline '{}' does not exist in corridor '{}'.".format(
                        baseline_name_check, corridor_name
                    ),
                    None,
                    baseline_name_original
                )

            tr.Commit()
        finally:
            tr.Dispose()

except Exception as ex:
    OUT = result(
        False,
        "ERROR: Civil 3D API failure: {}".format(ex),
        None,
        baseline_name_original
    )
# ----------------------------------------
number = DoubleInput(2)
getItemAtIndex = List.GetItemAtIndex(list=baseline_exist_yes_or_no, index=number)

# group: Input Data Basic
excel_file_input = Filename(".\List_Stations_Solids.xlsx")  # graph input
property_set_personalized = StringInput("PKStations")  # graph input
property_pkstart = StringInput("PKStart")  # graph input
property_pkend = StringInput("PKEnd")  # graph input

# group: Data Excel by Stations
file_from_path = FileObject(path=excel_file_input)
excel_sheet_name = StringInput("Section1")  # graph input
boolean = BoolSelector(false)
importExcel = Data.ImportExcel(file=file_from_path, sheetName=excel_sheet_name, showExcel=boolean)
transpose = List.Transpose(lists=importExcel)
number_slider = DoubleSlider(1, range=0..100 step 0.1)
flatten = List.Flatten(list=transpose, amount=number_slider)
dropItems = List.DropItems(list=flatten, amount=number_slider)
stations = Python(IN[0]=dropItems)  # "Check.List.Stations"; CPython3; graph output
# ---------- stations.python (82 lines) ----------
# IN[0] = list to validate (expected strictly increasing numeric sequence)

def result(ok, msg, clean=None, issues=None):
    return (ok, msg, clean, issues)

data = IN[0]

# ---------- Basic checks ----------
if data is None:
    OUT = result(False, "ERROR: Input list is None.", None, None)
    raise SystemExit

if not isinstance(data, (list, tuple)):
    OUT = result(False, "ERROR: Input is not a list.", None, None)
    raise SystemExit

if len(data) == 0:
    OUT = result(False, "ERROR: Input list is empty.", None, None)
    raise SystemExit

issues = {
    "non_numeric": [],      # (index, value)
    "not_increasing": [],   # (prev_index, curr_index, prev_value, curr_value)
    "duplicates": []        # (prev_index, curr_index, value)
}

# ---------- Parse to floats (accept numeric strings like "10.5"; reject "10+5") ----------
clean = []
for i, v in enumerate(data):
    if v is None:
        issues["non_numeric"].append((i, v))
        continue
    try:
        # Dynamo may pass numbers as int/float; strings may appear from Excel/CSV
        fv = float(str(v).strip()) if isinstance(v, str) else float(v)
        clean.append(fv)
    except:
        issues["non_numeric"].append((i, v))

if issues["non_numeric"]:
    OUT = result(
        False,
        "ERROR: Non-numeric values detected in the input list.",
        None,
        issues
    )
    raise SystemExit

# ---------- Strictly increasing check (no duplicates, no decreases) ----------
# Tolerance helps with floating point noise (e.g., 50.2540000001)
tol = 1e-9

for i in range(1, len(clean)):
    prev = clean[i - 1]
    curr = clean[i]

    if abs(curr - prev) <= tol:
        issues["duplicates"].append((i - 1, i, prev))
    elif curr < prev - tol:
        issues["not_increasing"].append((i - 1, i, prev, curr))

# ---------- Final decision ----------
if issues["duplicates"] or issues["not_increasing"]:
    parts = []
    if issues["duplicates"]:
        parts.append("duplicate values (equal consecutive entries)")
    if issues["not_increasing"]:
        parts.append("non-increasing steps (a value is smaller than the previous one)")

    OUT = result(
        False,
        "ERROR: Input list is invalid: " + " and ".join(parts) + ".",
        None,
        issues
    )
else:
    OUT = result(
        True,
        "OK: Input list is strictly increasing and numeric (decimals allowed).",
        clean,
        None
    )
# ----------------------------------------
number_2 = DoubleInput(2)
getItemAtIndex_2 = List.GetItemAtIndex(list=stations, index=number_2)
watch = Watch(getItemAtIndex_2)

# group: Solids by Stations
getSolids = Autodesk.Civil.DynamoNodes.Corridor.GetSolids(corridor=corridors, baselineName=getItemAtIndex)
flatten_2 = List.Flatten(list=getSolids)
baselineByName = Autodesk.Civil.DynamoNodes.Corridor.BaselineByName(corridor=corridors, baselineName=getItemAtIndex)
coordinateSystemByStation = Autodesk.Civil.DynamoNodes.Baseline.CoordinateSystemByStation(baseline=baselineByName, station=watch)
ZXPlane = CoordinateSystem.ZXPlane(coordinateSystem=coordinateSystemByStation)
flatten_3 = List.Flatten(list=ZXPlane)
sliceByPlanes = Autodesk.AutoCAD.DynamoNodes.Solid.SliceByPlanes(solid=flatten_2, planes=flatten_3)

debug = CodeBlock(Solids=sliceByPlanes) { Solids; }
propertySetByName = Autodesk.AutoCAD.DynamoNodes.Object.PropertySetByName(object=debug, propertySetName=property_set_personalized)

# group: Property Sets Data
propertyByName = Autodesk.AutoCAD.DynamoNodes.PropertySet.PropertyByName(propertySet=propertySetByName)  # unwired: propertyName
count = List.Count(list=propertyByName)
cycle = List.Cycle(amount=count)  # unwired: list
string_from_object = FromObject()  # unwired: object
setValue = Autodesk.AutoCAD.DynamoNodes.Property.SetValue(property=cycle, value=string_from_object)
propertyByName_2 = Autodesk.AutoCAD.DynamoNodes.PropertySet.PropertyByName(propertySet=propertySetByName)  # unwired: propertyName
string_from_object_2 = FromObject()  # unwired: object
setValue_2 = Autodesk.AutoCAD.DynamoNodes.Property.SetValue(property=propertyByName_2, value=string_from_object_2)

# group: PK Stations Start-End Property Sets
propertyByName_3 = Autodesk.AutoCAD.DynamoNodes.PropertySet.PropertyByName(propertySet=propertySetByName, propertyName=property_pkstart)
geometry = Autodesk.AutoCAD.DynamoNodes.Object.Geometry(object=debug)
vertices = Topology.Vertices(topology=geometry)
pointGeometry = Vertex.PointGeometry(vertex=vertices)
stationOffsetByPoint = Autodesk.Civil.DynamoNodes.Baseline.StationOffsetByPoint(baseline=baselineByName, point=pointGeometry)
minimumItem = List.MinimumItem(list=stationOffsetByPoint.Station)
setValue_3 = Autodesk.AutoCAD.DynamoNodes.Property.SetValue(property=propertyByName_3, value=minimumItem)
propertyByName_4 = Autodesk.AutoCAD.DynamoNodes.PropertySet.PropertyByName(propertySet=propertySetByName, propertyName=property_pkend)
maximumItem = List.MaximumItem(list=stationOffsetByPoint.Station)
setValue_4 = Autodesk.AutoCAD.DynamoNodes.Property.SetValue(property=propertyByName_4, value=maximumItem)
