# Dynamo graph Supplementary File 2_Script_Pave_interval.dyn (Dynamo 3.3.1.7726)
# packages: Civil3DToolkit 1.1.30

# group: Corridor object from file
corridors = CorridorNameDropDown()  # nothing selected; graph input

# group: Baseline and coordinate system at increment of 10m station
baselines = Autodesk.Civil.DynamoNodes.Corridor.Baselines(corridor=corridors)
code_block = CodeBlock(a=baselines) { a[0]; }
startStation = Autodesk.Civil.DynamoNodes.Baseline.StartStation(baseline=code_block)
interval = DoubleInput(10)  # graph input
endStation = Autodesk.Civil.DynamoNodes.Baseline.EndStation(baseline=code_block)
code_block_2 = CodeBlock(s=startStation, b=interval, e=endStation) { s+b..e..b; }
coordinateSystemByStation = Autodesk.Civil.DynamoNodes.Baseline.CoordinateSystemByStation(baseline=code_block, station=code_block_2)

# group: Solids and split them by Stations
getSolids = Autodesk.Civil.DynamoNodes.Corridor.GetSolids(corridor=corridors)
ZXPlane = CoordinateSystem.ZXPlane(coordinateSystem=coordinateSystemByStation)
sliceByPlanes = Autodesk.AutoCAD.DynamoNodes.Solid.SliceByPlanes(solid=getSolids, planes=ZXPlane)

# group: Porperty Set Name and Definition
porpertyset_name = StringInput("PKStations")  # graph input
property_start_station = StringInput("PKStart")  # graph input
property_end_station = StringInput("PKEnd")  # graph input

# group: Create PropertySet and Assign Properties to solids by Stations
propertySetByName = Autodesk.AutoCAD.DynamoNodes.Object.PropertySetByName(object=sliceByPlanes, propertySetName=porpertyset_name)
propertyByName = Autodesk.AutoCAD.DynamoNodes.PropertySet.PropertyByName(propertySet=propertySetByName, propertyName=property_start_station)
geometry = Autodesk.AutoCAD.DynamoNodes.Object.Geometry(object=sliceByPlanes)
vertices = Topology.Vertices(topology=geometry)
pointGeometry = Vertex.PointGeometry(vertex=vertices)
stationOffsetByPoint = Autodesk.Civil.DynamoNodes.Baseline.StationOffsetByPoint(baseline=code_block, point=pointGeometry)
minimumItem = List.MinimumItem(list=stationOffsetByPoint.Station)
setValue = Autodesk.AutoCAD.DynamoNodes.Property.SetValue(property=propertyByName, value=minimumItem)
propertyByName_2 = Autodesk.AutoCAD.DynamoNodes.PropertySet.PropertyByName(propertySet=propertySetByName, propertyName=property_end_station)
maximumItem = List.MaximumItem(list=stationOffsetByPoint.Station)
setValue_2 = Autodesk.AutoCAD.DynamoNodes.Property.SetValue(property=propertyByName_2, value=maximumItem)
