# Dynamo graph Supplementary File 3_Script_Earthworks.dyn "Civil3D_SplitCorridorSolid_Earthworks" (Dynamo 3.3.1.7726)
# packages: Civil3DToolkit 1.1.30

# group: Corridor object from file
select_objects = ObjectsSelection()  # 1 picked in the model; graph input
corridors = CorridorNameDropDown("T1_0-1040")  # graph input
interval = DoubleInput(10)  # graph input

# group: Baseline and coordinate system at increment of 10m station
baselines = Autodesk.Civil.DynamoNodes.Corridor.Baselines(corridor=corridors)
code_block = CodeBlock(a=baselines) { a[0]; }
startStation = Autodesk.Civil.DynamoNodes.Baseline.StartStation(baseline=code_block)
endStation = Autodesk.Civil.DynamoNodes.Baseline.EndStation(baseline=code_block)
code_block_2 = CodeBlock(s=startStation, a=interval, e=endStation) { s+a..e..a; }
coordinateSystemByStation = Autodesk.Civil.DynamoNodes.Baseline.CoordinateSystemByStation(baseline=code_block, station=code_block_2)

# group: Solids and split them by Stations
ZXPlane = CoordinateSystem.ZXPlane(coordinateSystem=coordinateSystemByStation)
sliceByPlanes = Autodesk.AutoCAD.DynamoNodes.Solid.SliceByPlanes(solid=select_objects, planes=ZXPlane)

# group: Porperty Set Name and Definition
porpertyset_name = StringInput("PKStations")  # graph input
property_start_station = StringInput("PKStart")  # graph input
property_end_station = StringInput("PKEnd")  # graph input

# group: Create PropertySet and Assign Properties to solids by Stations
propertySetByName = Autodesk.AutoCAD.DynamoNodes.Object.PropertySetByName(object=sliceByPlanes, propertySetName=porpertyset_name)
propertyByName = Autodesk.AutoCAD.DynamoNodes.PropertySet.PropertyByName(propertySet=propertySetByName, propertyName=property_start_station)
geometry = Autodesk.AutoCAD.DynamoNodes.Object.Geometry(object=sliceByPlanes)
vertices = Topology.Vertices(topology=geometry)
pointGeometry = Vertex.PointGeometry(vertex=vertices)
stationOffsetByPoint = Autodesk.Civil.DynamoNodes.Baseline.StationOffsetByPoint(baseline=code_block, point=pointGeometry)
minimumItem = List.MinimumItem(list=stationOffsetByPoint.Station)
setValue = Autodesk.AutoCAD.DynamoNodes.Property.SetValue(property=propertyByName, value=minimumItem)
propertyByName_2 = Autodesk.AutoCAD.DynamoNodes.PropertySet.PropertyByName(propertySet=propertySetByName, propertyName=property_end_station)
maximumItem = List.MaximumItem(list=stationOffsetByPoint.Station)
setValue_2 = Autodesk.AutoCAD.DynamoNodes.Property.SetValue(property=propertyByName_2, value=maximumItem)
