# Dynamo graph TrafficBarrierCorridorTool_PKReal_v1.dyn (Dynamo 3.6.1.9956)
# author: Carlos Peña
# Automatically places BIM traffic signs along a Civil 3D corridor from an Excel template, assigning IFC property sets, geometry, scheduling and cost attributes.
# packages: Civil3DToolkit 1.1.32

# group: INPUT_DATA
corridors = CorridorNameDropDown("T1-6+300_7+300")  # graph input
excel_file = Filename(".\TrafficSign_BIM_Template_PKReal_v4.xlsx")  # graph input
point_code = StringInput("ETW")  # graph input
point_code_2 = StringInput("EPS")  # graph input
barrier_block_library = Directory("C:\Users\CARLOS\Desktop\BIM_SIGNS\BARRIER_LIBRARY")  # graph input

# group: FEATURE LINES AND SIDE (L or R)
baselines = Autodesk.Civil.DynamoNodes.Corridor.Baselines(corridor=corridors)
list_create = List.Create(item0=point_code, item1=point_code_2)
corridorFeatureLinesByCode = Autodesk.Civil.DynamoNodes.Baseline.CorridorFeatureLinesByCode(baseline=baselines, pointCode=list_create@L2, lacing=Shortest)
code_block = CodeBlock { -1; }
flatten = List.Flatten(list=corridorFeatureLinesByCode, amount=code_block)
side = Autodesk.Civil.DynamoNodes.CorridorFeatureLine.Side(corridorFeatureLine=flatten)
code_block_2 = CodeBlock { 0; }
gt = side > code_block_2
filterByBoolMask = List.FilterByBoolMask(list=flatten, mask=gt)

# group: EXCEL DATA SHEET IMPORT
excelSheet = StringInput("BARRIERS")  # graph input
code_block_3 = CodeBlock { 1; }
code_block_4 = CodeBlock { 0; }
code_block_5 = CodeBlock { false; }
openXMLImportExcel = Data.OpenXMLImportExcel(filePath=excel_file, sheetName=excelSheet, startRow=code_block_3, startColumn=code_block_4, readAsString=code_block_5)
excelSheet_2 = StringInput("SectionTypeOffset")  # graph input
openXMLImportExcel_2 = Data.OpenXMLImportExcel(filePath=excel_file, sheetName=excelSheet_2, startRow=code_block_3, startColumn=code_block_4, readAsString=code_block_5)
READ_VALIDATE_BARRIER_DATA = Python(IN[0]=openXMLImportExcel, IN[1]=openXMLImportExcel_2)  # CPython3
# ---------- READ_VALIDATE_BARRIER_DATA.python (683 lines) ----------
# CPython3 - READ_VALIDATE_BARRIER_DATA_V3
#
# IN[0] = BARRIERS worksheet
# IN[1] = SectionTypeOffset worksheet
#
# OUT[0] = Valid BarrierData
# OUT[1] = Valid SectionTypeOffset
# OUT[2] = InvalidRows
# OUT[3] = Warnings

import re

barrier_data = IN[0]
section_data = IN[1]


# ============================================================
# AUXILIARY FUNCTIONS
# ============================================================

def clean_text(value):
    if value is None:
        return ""

    text = str(value)

    text = text.replace("\u00A0", " ")
    text = text.replace("\u200B", "")
    text = text.replace("\ufeff", "")
    text = text.replace("\r", "")
    text = text.replace("\n", "")

    return text.strip()


def to_number(value):
    if value is None:
        return None

    if isinstance(value, (int, float)):
        return float(value)

    text = clean_text(value).replace(" ", "")

    if text == "":
        return None

    # Allows station labels such as 6+300.00
    text = text.replace("+", "")

    # Decimal comma
    if "," in text and "." not in text:
        text = text.replace(",", ".")

    # Keep only valid numeric characters
    text = re.sub(r"[^0-9.\-]", "", text)

    try:
        return float(text)
    except:
        return None


def norm_side(value):
    text = clean_text(value).upper()

    if text in [
        "LEFT",
        "L",
        "IZQUIERDA",
        "IZQ",
        "I"
    ]:
        return "LEFT"

    if text in [
        "RIGHT",
        "R",
        "DERECHA",
        "DER",
        "D"
    ]:
        return "RIGHT"

    return text


def is_empty_row(row):
    if row is None:
        return True

    if not isinstance(row, (list, tuple)):
        return True

    for value in row:
        if value is not None and clean_text(value) != "":
            return False

    return True


def is_barrier_header(row):
    if row is None or len(row) == 0:
        return False

    return clean_text(row[0]).upper() == "ID"


def is_section_header(row):
    if row is None or len(row) < 2:
        return False

    first = clean_text(row[0]).upper()
    second = clean_text(row[1]).upper()

    return (
        first == "BASELINE"
        or second in [
            "SECTIONTYPE",
            "SECTION TYPE"
        ]
    )


def pad_row(row, required_length):
    """
    Completes short OpenXML rows with None.
    Excel/OpenXML may omit trailing empty cells.
    """
    if row is None:
        return [None] * required_length

    result = list(row)

    if len(result) < required_length:
        result += [None] * (
            required_length - len(result)
        )

    return result


# ============================================================
# OUTPUT COLLECTIONS
# ============================================================

valid_barriers = []
clean_sections = []

invalid_rows = []
warnings = []


# ============================================================
# READ SECTIONTYPEOFFSET
#
# Expected useful columns:
#
# 0 Baseline
# 1 SectionType
# 2 OffsetLeft
# 3 OffsetRight
# ============================================================

if section_data is None:
    section_data = []

for idx, original_row in enumerate(section_data):

    excel_row = idx + 2

    if is_empty_row(original_row):
        continue

    if is_section_header(original_row):
        continue

    # Protect against omitted trailing cells
    row = pad_row(
        original_row,
        4
    )

    baseline = clean_text(
        row[0]
    )

    section_type = clean_text(
        row[1]
    )

    offset_left = to_number(
        row[2]
    )

    offset_right = to_number(
        row[3]
    )

    errors = []

    if baseline == "":
        errors.append(
            "Baseline is empty"
        )

    if section_type == "":
        errors.append(
            "SectionType is empty"
        )

    if offset_left is None:
        errors.append(
            "invalid OffsetLeft"
        )

    if offset_right is None:
        errors.append(
            "invalid OffsetRight"
        )


    if len(errors) > 0:

        invalid_rows.append({
            "Source":
                "SectionTypeOffset",

            "Row":
                excel_row,

            "Data":
                list(original_row)
        })

        warnings.append(
            "SectionTypeOffset row {}: {}."
            .format(
                excel_row,
                "; ".join(errors)
            )
        )

        continue


    clean_sections.append({

        "Baseline":
            baseline,

        "SectionType":
            section_type,

        "OffsetLeft":
            offset_left,

        "OffsetRight":
            offset_right
    })


# ============================================================
# READ BARRIERS
#
# CURRENT DEFINITIVE ORDER
#
#  0 ID
#  1 Side
#  2 PKStartValue
#  3 PKEndValue
#  4 Offset
#  5 Type
#  6 PKStartLabel
#  7 PKEndLabel
#  8 BarrierFamily
#  9 BarrierType
# 10 BlockLinear
# 11 BlockPost
# 12 IFCEntity
# 13 Material
# 14 PostSpacing
# 15 ModuleLength
# 16 Height
# 17 Width
# 18 ContainmentLevel
# 19 WorkingWidth
# 20 Layer
# 21 TimeUnitLength(h)
# 22 CostUnitLength
# 23 Notes
#
# OpenXML may return fewer than 24 cells if
# trailing Excel cells are empty.
# ============================================================

if barrier_data is None:
    barrier_data = []

for idx, original_row in enumerate(barrier_data):

    excel_row = idx + 2

    if is_empty_row(original_row):
        continue

    if is_barrier_header(original_row):
        continue


    # ========================================================
    # IMPORTANT FIX:
    # Complete the row instead of rejecting it.
    # ========================================================

    row = pad_row(
        original_row,
        24
    )


    # --------------------------------------------------------
    # READ VALUES
    # --------------------------------------------------------

    barrier_id = clean_text(
        row[0]
    )

    side = norm_side(
        row[1]
    )

    pk_start = to_number(
        row[2]
    )

    pk_end = to_number(
        row[3]
    )

    default_offset = to_number(
        row[4]
    )

    type_code = clean_text(
        row[5]
    )

    pk_start_label = clean_text(
        row[6]
    )

    pk_end_label = clean_text(
        row[7]
    )

    barrier_family = clean_text(
        row[8]
    )

    barrier_type = clean_text(
        row[9]
    )

    block_linear = clean_text(
        row[10]
    )

    block_post = clean_text(
        row[11]
    )

    ifc_entity = clean_text(
        row[12]
    )

    material = clean_text(
        row[13]
    )

    post_spacing = to_number(
        row[14]
    )

    module_length = to_number(
        row[15]
    )

    height = to_number(
        row[16]
    )

    width = to_number(
        row[17]
    )

    containment_level = clean_text(
        row[18]
    )

    working_width = clean_text(
        row[19]
    )

    layer = clean_text(
        row[20]
    )

    time_unit_length = to_number(
        row[21]
    )

    cost_unit_length = to_number(
        row[22]
    )

    notes = clean_text(
        row[23]
    )


    # --------------------------------------------------------
    # DEFAULT VALUES
    #
    # 0 means that component is not applicable.
    # --------------------------------------------------------

    if post_spacing is None:
        post_spacing = 0.0

    if module_length is None:
        module_length = 0.0


    # --------------------------------------------------------
    # VALIDATION
    # --------------------------------------------------------

    errors = []


    if barrier_id == "":
        errors.append(
            "ID is empty"
        )


    if side not in [
        "LEFT",
        "RIGHT"
    ]:
        errors.append(
            "invalid Side"
        )


    if pk_start is None:
        errors.append(
            "invalid PKStartValue"
        )


    if pk_end is None:
        errors.append(
            "invalid PKEndValue"
        )


    if (
        pk_start is not None
        and pk_end is not None
        and pk_end <= pk_start
    ):
        errors.append(
            "PKEndValue must be greater than PKStartValue"
        )


    if type_code == "":
        errors.append(
            "Type is empty"
        )


    if height is None:
        errors.append(
            "invalid Height"
        )


    if width is None:
        errors.append(
            "invalid Width"
        )


    if post_spacing < 0:
        errors.append(
            "PostSpacing cannot be negative"
        )


    if module_length < 0:
        errors.append(
            "ModuleLength cannot be negative"
        )


    # --------------------------------------------------------
    # COMPONENT CONSISTENCY
    # --------------------------------------------------------

    if (
        post_spacing > 0
        and block_post == ""
    ):
        errors.append(
            "PostSpacing > 0 but BlockPost is empty"
        )


    if (
        module_length > 0
        and block_linear == ""
    ):
        errors.append(
            "ModuleLength > 0 but BlockLinear is empty"
        )


    # --------------------------------------------------------
    # INVALID ROW
    # --------------------------------------------------------

    if len(errors) > 0:

        invalid_rows.append({

            "Source":
                "BARRIERS",

            "Row":
                excel_row,

            "ID":
                barrier_id,

            "Data":
                list(original_row)
        })


        warnings.append(
            "BARRIERS row {} | ID '{}': {}."
            .format(
                excel_row,
                barrier_id,
                "; ".join(errors)
            )
        )

        continue


    # --------------------------------------------------------
    # COMPONENT LOGIC
    # --------------------------------------------------------

    has_posts = (
        post_spacing > 0
    )

    has_modules = (
        module_length > 0
    )


    # --------------------------------------------------------
    # STRUCTURED RECORD
    # --------------------------------------------------------

    record = {

        "ID":
            barrier_id,

        "Side":
            side,

        "PKStartValue":
            pk_start,

        "PKEndValue":
            pk_end,

        "DefaultOffset":
            default_offset,

        "Type":
            type_code,

        "PKStartLabel":
            pk_start_label,

        "PKEndLabel":
            pk_end_label,

        "BarrierFamily":
            barrier_family,

        "BarrierType":
            barrier_type,

        "BlockLinear":
            block_linear,

        "BlockPost":
            block_post,

        "IFCEntity":
            ifc_entity,

        "Material":
            material,

        "PostSpacing":
            post_spacing,

        "ModuleLength":
            module_length,

        "HasPosts":
            has_posts,

        "HasModules":
            has_modules,

        "Height":
            height,

        "Width":
            width,

        "ContainmentLevel":
            containment_level,

        "WorkingWidth":
            working_width,

        "Layer":
            layer,

        "TimeUnitLength(h)":
            time_unit_length,

        "CostUnitLength":
            cost_unit_length,

        "Notes":
            notes,

        # Store the normalized 24-column row
        "SourceRow":
            list(row[:24])
    }


    valid_barriers.append(
        record
    )


# ============================================================
# OUTPUT
# ============================================================

OUT = (
    valid_barriers,   # 0 - BarrierData
    clean_sections,   # 1 - SectionTypeOffset
    invalid_rows,     # 2 - Invalid rows
    warnings          # 3 - Warnings
)
# ----------------------------------------
code_block_6 = CodeBlock(data=READ_VALIDATE_BARRIER_DATA) { data[0]; data[1]; data[2]; data[3]; }

# group: SECTION_SEGMENT_BUILDER
regions = Autodesk.Civil.DynamoNodes.Baseline.Regions(baseline=baselines)
startStation = Autodesk.Civil.DynamoNodes.BaselineRegion.StartStation(baselineRegion=regions)
endStation = Autodesk.Civil.DynamoNodes.BaselineRegion.EndStation(baselineRegion=regions)
assembly = Autodesk.Civil.DynamoNodes.BaselineRegion.Assembly(baselineRegion=regions)
SECTION_OFFSET_SOLVER_V1 = Python(IN[0]=code_block_6.out0, IN[1]=startStation, IN[2]=endStation, IN[3]=assembly)  # CPython3
# ---------- SECTION_OFFSET_SOLVER_V1.python (462 lines) ----------
# CPython3 - SECTION_OFFSET_SOLVER_V1
#
# PURPOSE:
# Splits each barrier into subsegments according to
# Civil 3D corridor baseline regions.
#
# IN[0] = Clean BarrierData
# IN[1] = Region Start Stations
# IN[2] = Region End Stations
# IN[3] = Region Assemblies
#
# OUT[0] = BarrierSegmentData
# OUT[1] = InvalidSegments
# OUT[2] = Warnings
# OUT[3] = Summary


# ============================================================
# INPUTS
# ============================================================

barrier_data = IN[0]
region_starts_input = IN[1]
region_ends_input = IN[2]
region_assemblies_input = IN[3]


# ============================================================
# AUXILIARY FUNCTIONS
# ============================================================

def as_list(value):
    """
    Converts Dynamo inputs into a flat Python list.
    """
    if value is None:
        return []

    if isinstance(value, (list, tuple)):
        result = []

        for item in value:
            if isinstance(item, (list, tuple)):
                result.extend(as_list(item))
            else:
                result.append(item)

        return result

    return [value]


def clean_text(value):
    """
    Converts any value to clean text.
    """
    if value is None:
        return ""

    text = str(value)

    text = text.replace("\u00A0", " ")
    text = text.replace("\u200B", "")
    text = text.replace("\ufeff", "")
    text = text.replace("\r", "")
    text = text.replace("\n", "")

    return text.strip()


def to_number(value):
    """
    Converts Dynamo / Excel numeric values to float.
    """
    if value is None:
        return None

    if isinstance(value, (int, float)):
        return float(value)

    text = clean_text(value).replace(" ", "")

    if text == "":
        return None

    text = text.replace("+", "")

    if "," in text and "." not in text:
        text = text.replace(",", ".")

    try:
        return float(text)

    except Exception:
        return None


def get_dict_value(dictionary, key):
    """
    Safely reads a value from a Python or Dynamo dictionary.
    """
    if dictionary is None:
        return None

    try:
        if isinstance(dictionary, dict):
            return dictionary.get(key)

        if hasattr(dictionary, "ValueAtKey"):
            return dictionary.ValueAtKey(key)

        return dictionary[key]

    except Exception:
        return None


def get_assembly_name(value):
    """
    Attempts to obtain the Assembly name from the Civil 3D object.
    """
    if value is None:
        return ""

    # Civil 3D / Dynamo object may expose Name directly
    try:
        if hasattr(value, "Name"):
            return clean_text(value.Name)
    except Exception:
        pass

    # Fall back to string representation
    text = clean_text(value)

    # Common Dynamo representation:
    # Assembly(Name = ST_2)
    if "Name =" in text:
        try:
            name_part = text.split("Name =", 1)[1]
            name_part = name_part.split(")", 1)[0]
            return clean_text(name_part)
        except Exception:
            pass

    return text


# ============================================================
# PREPARE REGION DATA
# ============================================================

region_starts = as_list(region_starts_input)
region_ends = as_list(region_ends_input)
region_assemblies = as_list(region_assemblies_input)

barriers = as_list(barrier_data)


barrier_segments = []
invalid_segments = []
warnings = []
summary = []


# ============================================================
# VALIDATE REGION INPUT LENGTHS
# ============================================================

region_count = min(
    len(region_starts),
    len(region_ends),
    len(region_assemblies)
)

if region_count == 0:

    warnings.append(
        "No valid corridor region data was received."
    )

else:

    # Build a clean list of corridor regions
    corridor_regions = []

    for index in range(region_count):

        start_station = to_number(
            region_starts[index]
        )

        end_station = to_number(
            region_ends[index]
        )

        assembly_name = get_assembly_name(
            region_assemblies[index]
        )

        if start_station is None or end_station is None:

            warnings.append(
                "Region {}: invalid start or end station."
                .format(index)
            )

            continue

        if end_station <= start_station:

            warnings.append(
                "Region {}: EndStation must be greater "
                "than StartStation."
                .format(index)
            )

            continue

        corridor_regions.append({
            "RegionIndex": index,
            "StartStation": start_station,
            "EndStation": end_station,
            "Assembly": assembly_name
        })


    # Sort regions by station
    corridor_regions = sorted(
        corridor_regions,
        key=lambda item: item["StartStation"]
    )


    # ========================================================
    # PROCESS BARRIERS
    # ========================================================

    for barrier_index, barrier in enumerate(barriers):

        barrier_id = clean_text(
            get_dict_value(barrier, "ID")
        )

        side = clean_text(
            get_dict_value(barrier, "Side")
        ).upper()

        barrier_start = to_number(
            get_dict_value(
                barrier,
                "PKStartValue"
            )
        )

        barrier_end = to_number(
            get_dict_value(
                barrier,
                "PKEndValue"
            )
        )

        # ----------------------------------------------------
        # Basic barrier validation
        # ----------------------------------------------------

        if barrier_id == "":
            barrier_id = "Barrier_{}".format(
                barrier_index + 1
            )

        if barrier_start is None or barrier_end is None:

            invalid_segments.append({
                "ParentID": barrier_id,
                "Reason": "Invalid PKStartValue or PKEndValue."
            })

            continue

        if barrier_end <= barrier_start:

            invalid_segments.append({
                "ParentID": barrier_id,
                "Reason":
                    "PKEndValue must be greater than PKStartValue."
            })

            continue


        # ----------------------------------------------------
        # Find intersections with corridor regions
        # ----------------------------------------------------

        generated_count = 0

        covered_length = 0.0

        for region in corridor_regions:

            region_start = region["StartStation"]
            region_end = region["EndStation"]

            # Intersection of:
            #
            # [barrier_start, barrier_end]
            #
            # with
            #
            # [region_start, region_end]

            segment_start = max(
                barrier_start,
                region_start
            )

            segment_end = min(
                barrier_end,
                region_end
            )

            # No overlap
            if segment_end <= segment_start:
                continue

            segment_length = (
                segment_end - segment_start
            )

            generated_count += 1
            covered_length += segment_length

            # ------------------------------------------------
            # Unique segment ID
            # ------------------------------------------------

            segment_id = "{}_S{:02d}".format(
                barrier_id,
                generated_count
            )

            # ------------------------------------------------
            # Create segment record
            # ------------------------------------------------

            segment_record = {

                "ID": segment_id,

                "ParentID": barrier_id,

                "SegmentIndex":
                    generated_count,

                "StartStation":
                    segment_start,

                "EndStation":
                    segment_end,

                "Length":
                    segment_length,

                "Side":
                    side,

                "Assembly":
                    region["Assembly"],

                "RegionIndex":
                    region["RegionIndex"],

                # Keep complete parent data so later modules
                # do not need to return to Excel.
                "ParentData":
                    barrier
            }

            barrier_segments.append(
                segment_record
            )


        # ----------------------------------------------------
        # No intersecting region found
        # ----------------------------------------------------

        if generated_count == 0:

            invalid_segments.append({
                "ParentID": barrier_id,
                "StartStation": barrier_start,
                "EndStation": barrier_end,
                "Reason":
                    "Barrier does not intersect any corridor region."
            })

            continue


        # ----------------------------------------------------
        # Check whether complete barrier length was covered
        # ----------------------------------------------------

        original_length = (
            barrier_end - barrier_start
        )

        difference = abs(
            original_length - covered_length
        )

        if difference > 0.001:

            warnings.append(
                "Barrier '{}': corridor regions cover "
                "{:.3f} m of {:.3f} m. "
                "Uncovered length = {:.3f} m."
                .format(
                    barrier_id,
                    covered_length,
                    original_length,
                    difference
                )
            )


        # ----------------------------------------------------
        # Barrier summary
        # ----------------------------------------------------

        summary.append({
            "ParentID":
                barrier_id,

            "StartStation":
                barrier_start,

            "EndStation":
                barrier_end,

            "OriginalLength":
                original_length,

            "GeneratedSegments":
                generated_count,

            "CoveredLength":
                covered_length
        })


# ============================================================
# OUTPUTS
# ============================================================

OUT = (
    barrier_segments,   # 0 - BarrierSegmentData
    invalid_segments,   # 1 - InvalidSegments
    warnings,           # 2 - Warnings
    summary             # 3 - Summary
)
# ----------------------------------------
code_block_7 = CodeBlock(seg=SECTION_OFFSET_SOLVER_V1) { seg[0]; seg[1]; seg[2]; seg[3]; }
SECTION_OFFSET_SOLVER_V2 = Python(IN[0]=code_block_7.out0, IN[1]=code_block_6.out1)  # CPython3
# ---------- SECTION_OFFSET_SOLVER_V2.python (369 lines) ----------
# CPython3 - SECTION_OFFSET_SOLVER_V2
#
# PURPOSE:
# Adds section-dependent LEFT/RIGHT offsets to each barrier segment.
#
# IN[0] = BarrierSegmentData from SECTION_OFFSET_SOLVER_V1
# IN[1] = Clean SectionTypeOffset data
#
# OUT[0] = Enriched BarrierSegmentData
# OUT[1] = InvalidSegments
# OUT[2] = Warnings
# OUT[3] = Summary


# ============================================================
# INPUTS
# ============================================================

segment_data = IN[0]
section_offset_data = IN[1]


# ============================================================
# AUXILIARY FUNCTIONS
# ============================================================

def as_list(value):
    if value is None:
        return []

    if isinstance(value, (list, tuple)):
        result = []

        for item in value:
            if isinstance(item, (list, tuple)):
                result.extend(as_list(item))
            else:
                result.append(item)

        return result

    return [value]


def clean_text(value):
    if value is None:
        return ""

    text = str(value)

    text = text.replace("\u00A0", " ")
    text = text.replace("\u200B", "")
    text = text.replace("\ufeff", "")
    text = text.replace("\r", "")
    text = text.replace("\n", "")

    return text.strip()


def to_number(value):
    if value is None:
        return None

    if isinstance(value, (int, float)):
        return float(value)

    text = clean_text(value).replace(" ", "")

    if text == "":
        return None

    text = text.replace("+", "")

    if "," in text and "." not in text:
        text = text.replace(",", ".")

    try:
        return float(text)

    except Exception:
        return None


def get_dict_value(dictionary, key):
    if dictionary is None:
        return None

    try:
        if isinstance(dictionary, dict):
            return dictionary.get(key)

        if hasattr(dictionary, "ValueAtKey"):
            return dictionary.ValueAtKey(key)

        return dictionary[key]

    except Exception:
        return None


def copy_dictionary(dictionary):
    """
    Converts incoming Dynamo/Python dictionary into
    a normal Python dictionary when possible.
    """
    if dictionary is None:
        return {}

    if isinstance(dictionary, dict):
        return dict(dictionary)

    result = {}

    try:
        keys = dictionary.Keys

        for key in keys:
            result[str(key)] = dictionary.ValueAtKey(key)

        return result

    except Exception:
        return result


# ============================================================
# PREPARE INPUTS
# ============================================================

segments = as_list(segment_data)
section_offsets = as_list(section_offset_data)

enriched_segments = []
invalid_segments = []
warnings = []
summary = []


# ============================================================
# BUILD SECTION OFFSET LOOKUP
#
# Key = SectionType / Assembly name
#
# Example:
# ST_1 ->
#   OffsetLeft  = 4.68
#   OffsetRight = 4.68
# ============================================================

section_lookup = {}

for index, record in enumerate(section_offsets):

    section_type = clean_text(
        get_dict_value(record, "SectionType")
    ).upper()

    baseline = clean_text(
        get_dict_value(record, "Baseline")
    )

    offset_left = to_number(
        get_dict_value(record, "OffsetLeft")
    )

    offset_right = to_number(
        get_dict_value(record, "OffsetRight")
    )

    if section_type == "":

        warnings.append(
            "SectionTypeOffset item {}: SectionType is empty."
            .format(index)
        )

        continue

    section_lookup[section_type] = {
        "Baseline": baseline,
        "OffsetLeft": offset_left,
        "OffsetRight": offset_right
    }


# ============================================================
# PROCESS BARRIER SEGMENTS
# ============================================================

for index, segment in enumerate(segments):

    parent_id = clean_text(
        get_dict_value(segment, "ParentID")
    )

    segment_id = clean_text(
        get_dict_value(segment, "ID")
    )

    assembly = clean_text(
        get_dict_value(segment, "Assembly")
    ).upper()

    side = clean_text(
        get_dict_value(segment, "Side")
    ).upper()

    start_station = to_number(
        get_dict_value(segment, "StartStation")
    )

    end_station = to_number(
        get_dict_value(segment, "EndStation")
    )


    # --------------------------------------------------------
    # Validate basic segment data
    # --------------------------------------------------------

    row_errors = []

    if assembly == "":
        row_errors.append("Assembly is empty")

    if side not in ["LEFT", "RIGHT"]:
        row_errors.append("invalid Side")

    if start_station is None:
        row_errors.append("invalid StartStation")

    if end_station is None:
        row_errors.append("invalid EndStation")


    # --------------------------------------------------------
    # Find section offset record
    # --------------------------------------------------------

    section_record = section_lookup.get(
        assembly
    )

    if section_record is None:

        row_errors.append(
            "Assembly '{}' was not found in SectionTypeOffset"
            .format(assembly)
        )


    # --------------------------------------------------------
    # Stop if invalid
    # --------------------------------------------------------

    if len(row_errors) > 0:

        invalid_segments.append({
            "ID": segment_id,
            "ParentID": parent_id,
            "Assembly": assembly,
            "Side": side,
            "Reason": "; ".join(row_errors)
        })

        warnings.append(
            "Segment '{}' | Parent '{}': {}."
            .format(
                segment_id,
                parent_id,
                "; ".join(row_errors)
            )
        )

        continue


    # --------------------------------------------------------
    # Select LEFT or RIGHT offset
    # --------------------------------------------------------

    if side == "LEFT":

        selected_offset = section_record[
            "OffsetLeft"
        ]

        offset_source = "OffsetLeft"

    else:

        selected_offset = section_record[
            "OffsetRight"
        ]

        offset_source = "OffsetRight"


    if selected_offset is None:

        invalid_segments.append({
            "ID": segment_id,
            "ParentID": parent_id,
            "Assembly": assembly,
            "Side": side,
            "Reason":
                "{} is null or invalid."
                .format(offset_source)
        })

        warnings.append(
            "Segment '{}': {} for '{}' is invalid."
            .format(
                segment_id,
                offset_source,
                assembly
            )
        )

        continue


    # --------------------------------------------------------
    # Create enriched segment
    # --------------------------------------------------------

    enriched = copy_dictionary(segment)

    enriched["SectionType"] = assembly

    enriched["SectionOffset"] = selected_offset

    enriched["OffsetSource"] = offset_source

    enriched["SectionBaseline"] = section_record[
        "Baseline"
    ]

    enriched_segments.append(
        enriched
    )


    # --------------------------------------------------------
    # Summary
    # --------------------------------------------------------

    summary.append({
        "ID": segment_id,
        "ParentID": parent_id,
        "SectionType": assembly,
        "Side": side,
        "StartStation": start_station,
        "EndStation": end_station,
        "SectionOffset": selected_offset,
        "OffsetSource": offset_source
    })


# ============================================================
# OUTPUTS
# ============================================================

OUT = (
    enriched_segments,   # 0
    invalid_segments,    # 1
    warnings,            # 2
    summary              # 3
)
# ----------------------------------------
code_block_8 = CodeBlock(v2=SECTION_OFFSET_SOLVER_V2) { v2[0]; v2[1]; v2[2]; v2[3]; }

# group: COORDINATES SYSTEMS
alignment = Autodesk.Civil.DynamoNodes.Baseline.Alignment(baseline=baselines)
REFERENCE_OFFSET_SOLVER = Python(IN[0]=code_block_8.out0, IN[1]=filterByBoolMask.out, IN[2]=filterByBoolMask.in)  # CPython3
# ---------- REFERENCE_OFFSET_SOLVER.python (482 lines) ----------
# CPython3 - REFERENCE_OFFSET_SOLVER
#
# PURPOSE:
# For each barrier segment:
#   1. Reads Side (LEFT / RIGHT)
#   2. Selects the corresponding Feature Line collection
#   3. Evaluates ETW/EPS at the segment StartStation
#   4. Selects the outermost valid reference
#   5. Applies the SectionOffset outward
#
# IN[0] = BarrierSegmentData from SECTION_OFFSET_SOLVER_V2
# IN[1] = LEFT corridor feature lines (ETW/EPS)
# IN[2] = RIGHT corridor feature lines (ETW/EPS)
#
# OUT[0] = Enriched BarrierSegmentData
# OUT[1] = InvalidSegments
# OUT[2] = Warnings
# OUT[3] = Summary


segment_data = IN[0]
left_feature_lines_input = IN[1]
right_feature_lines_input = IN[2]


# ============================================================
# AUXILIARY FUNCTIONS
# ============================================================

def as_list(value):
    if value is None:
        return []

    if isinstance(value, (list, tuple)):
        result = []

        for item in value:
            if isinstance(item, (list, tuple)):
                result.extend(as_list(item))
            else:
                result.append(item)

        return result

    return [value]


def clean_text(value):
    if value is None:
        return ""

    text = str(value)

    text = text.replace("\u00A0", " ")
    text = text.replace("\u200B", "")
    text = text.replace("\ufeff", "")
    text = text.replace("\r", "")
    text = text.replace("\n", "")

    return text.strip()


def to_number(value):
    if value is None:
        return None

    if isinstance(value, (int, float)):
        return float(value)

    text = clean_text(value).replace(" ", "")

    if text == "":
        return None

    text = text.replace("+", "")

    if "," in text and "." not in text:
        text = text.replace(",", ".")

    try:
        return float(text)

    except Exception:
        return None


def get_dict_value(dictionary, key):
    if dictionary is None:
        return None

    try:
        if isinstance(dictionary, dict):
            return dictionary.get(key)

        if hasattr(dictionary, "ValueAtKey"):
            return dictionary.ValueAtKey(key)

        return dictionary[key]

    except Exception:
        return None


def copy_dictionary(dictionary):
    if dictionary is None:
        return {}

    if isinstance(dictionary, dict):
        return dict(dictionary)

    result = {}

    try:
        keys = dictionary.Keys

        for key in keys:
            result[str(key)] = dictionary.ValueAtKey(key)

    except Exception:
        pass

    return result


def get_value(result, key):
    """
    Reads Offset or Elevation from the dictionary returned by
    CorridorFeatureLine.OffsetElevationByStation().
    """
    if result is None:
        return None

    try:
        if isinstance(result, dict):
            return result.get(key)

        if hasattr(result, "ValueAtKey"):
            return result.ValueAtKey(key)

        return result[key]

    except Exception:
        return None


def feature_line_label(feature_line):
    if feature_line is None:
        return ""

    try:
        return str(feature_line)

    except Exception:
        return "CorridorFeatureLine"


# ============================================================
# PREPARE INPUTS
# ============================================================

segments = as_list(segment_data)

left_feature_lines = as_list(
    left_feature_lines_input
)

right_feature_lines = as_list(
    right_feature_lines_input
)

enriched_segments = []
invalid_segments = []
warnings = []
summary = []


# ============================================================
# PROCESS SEGMENTS
# ============================================================

for index, segment in enumerate(segments):

    segment_id = clean_text(
        get_dict_value(segment, "ID")
    )

    parent_id = clean_text(
        get_dict_value(segment, "ParentID")
    )

    side = clean_text(
        get_dict_value(segment, "Side")
    ).upper()

    start_station = to_number(
        get_dict_value(segment, "StartStation")
    )

    section_offset = to_number(
        get_dict_value(segment, "SectionOffset")
    )


    # --------------------------------------------------------
    # Basic validation
    # --------------------------------------------------------

    errors = []

    if start_station is None:
        errors.append("invalid StartStation")

    if section_offset is None:
        errors.append("invalid SectionOffset")

    if side not in ["LEFT", "RIGHT"]:
        errors.append("invalid Side")

    if len(errors) > 0:

        invalid_segments.append({
            "ID": segment_id,
            "ParentID": parent_id,
            "Reason": "; ".join(errors)
        })

        warnings.append(
            "Segment '{}': {}."
            .format(
                segment_id,
                "; ".join(errors)
            )
        )

        continue


    # --------------------------------------------------------
    # Select Feature Lines according to Side
    # --------------------------------------------------------

    if side == "LEFT":

        feature_lines = left_feature_lines

    else:

        feature_lines = right_feature_lines


    if len(feature_lines) == 0:

        invalid_segments.append({
            "ID": segment_id,
            "ParentID": parent_id,
            "Side": side,
            "Reason":
                "No feature lines were received for this side."
        })

        warnings.append(
            "Segment '{}': no {} feature lines were received."
            .format(
                segment_id,
                side
            )
        )

        continue


    # --------------------------------------------------------
    # Evaluate ETW / EPS candidates
    # --------------------------------------------------------

    candidates = []

    for line_index, feature_line in enumerate(feature_lines):

        if feature_line is None:
            continue

        try:

            result = feature_line.OffsetElevationByStation(
                start_station
            )

            offset = to_number(
                get_value(result, "Offset")
            )

            elevation = to_number(
                get_value(result, "Elevation")
            )

            if offset is None:
                continue


            # ------------------------------------------------
            # Verify geometric side
            # ------------------------------------------------

            if side == "LEFT" and offset >= 0:
                continue

            if side == "RIGHT" and offset <= 0:
                continue


            candidates.append({
                "LineIndex":
                    line_index,

                "FeatureLine":
                    feature_line,

                "FeatureLineLabel":
                    feature_line_label(
                        feature_line
                    ),

                "ReferenceOffset":
                    offset,

                "ReferenceElevation":
                    elevation
            })


        except Exception:
            # Feature line may not exist in this region/station
            continue


    # --------------------------------------------------------
    # No valid reference
    # --------------------------------------------------------

    if len(candidates) == 0:

        invalid_segments.append({
            "ID":
                segment_id,

            "ParentID":
                parent_id,

            "StartStation":
                start_station,

            "Side":
                side,

            "Reason":
                "No valid ETW/EPS reference was found."
        })

        warnings.append(
            "Segment '{}': no valid ETW/EPS reference "
            "was found at station {}."
            .format(
                segment_id,
                start_station
            )
        )

        continue


    # --------------------------------------------------------
    # Select outermost ETW/EPS
    # --------------------------------------------------------

    selected = max(
        candidates,
        key=lambda item:
            abs(item["ReferenceOffset"])
    )

    reference_offset = selected[
        "ReferenceOffset"
    ]

    reference_elevation = selected[
        "ReferenceElevation"
    ]


    # --------------------------------------------------------
    # Apply SectionOffset outward
    # --------------------------------------------------------

    if side == "LEFT":
        direction = -1.0
    else:
        direction = 1.0


    final_offset = (
        reference_offset
        + direction * abs(section_offset)
    )


    # --------------------------------------------------------
    # Enrich SegmentData
    # --------------------------------------------------------

    enriched = copy_dictionary(segment)

    enriched["ReferenceOffset"] = (
        reference_offset
    )

    enriched["ReferenceElevation"] = (
        reference_elevation
    )

    enriched["FinalOffset"] = (
        final_offset
    )

    enriched["ReferenceFeatureLine"] = (
        selected["FeatureLineLabel"]
    )

    enriched["ReferenceLineIndex"] = (
        selected["LineIndex"]
    )

    enriched["ReferenceSide"] = side


    enriched_segments.append(
        enriched
    )


    # --------------------------------------------------------
    # Summary
    # --------------------------------------------------------

    summary.append({

        "ID":
            segment_id,

        "ParentID":
            parent_id,

        "StartStation":
            start_station,

        "Side":
            side,

        "ReferenceOffset":
            reference_offset,

        "SectionOffset":
            section_offset,

        "FinalOffset":
            final_offset,

        "ReferenceFeatureLine":
            selected["FeatureLineLabel"]
    })


# ============================================================
# OUTPUTS
# ============================================================

OUT = (
    enriched_segments,   # 0
    invalid_segments,    # 1
    warnings,            # 2
    summary              # 3
)
# ----------------------------------------
code_block_9 = CodeBlock(ref=REFERENCE_OFFSET_SOLVER) { ref[0]; ref[1]; ref[2]; ref[3]; }
sampling_step = DoubleInput(1)
BARRIER_STATION_GENERATOR = Python(IN[0]=code_block_9.out0, IN[1]=sampling_step)  # CPython3
# ---------- BARRIER_STATION_GENERATOR.python (434 lines) ----------
# CPython3 - BARRIER_STATION_GENERATOR_V2
#
# IN[0] = BarrierSegmentData from REFERENCE_OFFSET_SOLVER
# IN[1] = GeometrySampling step
#
# OUT[0] = Enriched SegmentData
# OUT[1] = Post station data
# OUT[2] = Module station data
# OUT[3] = Summary


segment_data = IN[0]
sampling_step_input = IN[1]


# ============================================================
# AUXILIARY FUNCTIONS
# ============================================================

def as_list(value):
    if value is None:
        return []

    if isinstance(value, (list, tuple)):
        result = []

        for item in value:
            if isinstance(item, (list, tuple)):
                result.extend(as_list(item))
            else:
                result.append(item)

        return result

    return [value]


def clean_text(value):
    if value is None:
        return ""

    return str(value).strip()


def to_number(value):
    if value is None:
        return None

    if isinstance(value, (int, float)):
        return float(value)

    try:
        return float(str(value).replace(",", "."))
    except:
        return None


def get_dict_value(dictionary, key):
    if dictionary is None:
        return None

    try:
        if isinstance(dictionary, dict):
            return dictionary.get(key)

        if hasattr(dictionary, "ValueAtKey"):
            return dictionary.ValueAtKey(key)

        return dictionary[key]

    except:
        return None


def copy_dictionary(dictionary):
    if dictionary is None:
        return {}

    if isinstance(dictionary, dict):
        return dict(dictionary)

    result = {}

    try:
        keys = dictionary.Keys

        for key in keys:
            result[str(key)] = dictionary.ValueAtKey(key)

    except:
        pass

    return result


def generate_stations(start, end, step):
    """
    Generates stations including start and end.
    """
    stations = []

    if step is None or step <= 0:
        return stations

    stations.append(round(start, 6))

    current = start

    while current + step < end:
        current += step
        stations.append(round(current, 6))

    if abs(stations[-1] - end) > 1e-6:
        stations.append(round(end, 6))

    return stations


def generate_module_stations(start, end, module_length):
    """
    Generates module insertion stations.
    The stations represent module START positions.

    Example:
    start = 200
    end = 210
    module_length = 2

    -> 200, 202, 204, 206, 208
    """

    stations = []

    if module_length is None or module_length <= 0:
        return stations

    current = start

    while current < end - 1e-6:

        stations.append(
            round(current, 6)
        )

        current += module_length

    return stations


# ============================================================
# INPUTS
# ============================================================

segments = as_list(segment_data)

sampling_step = to_number(
    sampling_step_input
)

if sampling_step is None or sampling_step <= 0:
    sampling_step = 1.0


# ============================================================
# OUTPUT COLLECTIONS
# ============================================================

enriched_segments = []

post_station_data = []

module_station_data = []

summary = []


# ============================================================
# PROCESS SEGMENTS
# ============================================================

for segment in segments:

    segment_id = clean_text(
        get_dict_value(segment, "ID")
    )

    parent_id = clean_text(
        get_dict_value(segment, "ParentID")
    )

    start_station = to_number(
        get_dict_value(
            segment,
            "StartStation"
        )
    )

    end_station = to_number(
        get_dict_value(
            segment,
            "EndStation"
        )
    )

    parent_data = get_dict_value(
        segment,
        "ParentData"
    )


    # --------------------------------------------------------
    # Read component parameters
    # --------------------------------------------------------

    post_spacing = to_number(
        get_dict_value(
            parent_data,
            "PostSpacing"
        )
    )

    module_length = to_number(
        get_dict_value(
            parent_data,
            "ModuleLength"
        )
    )


    if post_spacing is None:
        post_spacing = 0.0

    if module_length is None:
        module_length = 0.0


    # --------------------------------------------------------
    # Validate segment
    # --------------------------------------------------------

    if (
        start_station is None
        or end_station is None
        or end_station <= start_station
    ):
        continue


    # ========================================================
    # 1. GEOMETRY STATIONS
    # ========================================================

    geometry_stations = generate_stations(
        start_station,
        end_station,
        sampling_step
    )


    # ========================================================
    # 2. POST STATIONS
    # ========================================================

    if post_spacing > 0:

        post_stations = generate_stations(
            start_station,
            end_station,
            post_spacing
        )

    else:

        post_stations = []


    # ========================================================
    # 3. MODULE STATIONS
    # ========================================================

    if module_length > 0:

        module_stations = generate_module_stations(
            start_station,
            end_station,
            module_length
        )

    else:

        module_stations = []


    # ========================================================
    # ENRICH SEGMENT
    # ========================================================

    enriched = copy_dictionary(
        segment
    )

    enriched[
        "GeometryStations"
    ] = geometry_stations

    enriched[
        "PostStations"
    ] = post_stations

    enriched[
        "ModuleStations"
    ] = module_stations

    enriched[
        "GeometrySampling"
    ] = sampling_step

    enriched[
        "PostSpacing"
    ] = post_spacing

    enriched[
        "ModuleLength"
    ] = module_length

    enriched[
        "PostCount"
    ] = len(post_stations)

    enriched[
        "ModuleCount"
    ] = len(module_stations)


    enriched_segments.append(
        enriched
    )


    # ========================================================
    # POST DATA
    # ========================================================

    if len(post_stations) > 0:

        post_station_data.append({

            "ID":
                segment_id,

            "ParentID":
                parent_id,

            "PostStations":
                post_stations,

            "PostSpacing":
                post_spacing,

            "PostCount":
                len(post_stations)
        })


    # ========================================================
    # MODULE DATA
    # ========================================================

    if len(module_stations) > 0:

        module_station_data.append({

            "ID":
                segment_id,

            "ParentID":
                parent_id,

            "ModuleStations":
                module_stations,

            "ModuleLength":
                module_length,

            "ModuleCount":
                len(module_stations)
        })


    # ========================================================
    # SUMMARY
    # ========================================================

    summary.append({

        "ID":
            segment_id,

        "ParentID":
            parent_id,

        "StartStation":
            start_station,

        "EndStation":
            end_station,

        "GeometryPointCount":
            len(geometry_stations),

        "PostSpacing":
            post_spacing,

        "PostCount":
            len(post_stations),

        "ModuleLength":
            module_length,

        "ModuleCount":
            len(module_stations)
    })


# ============================================================
# OUTPUT
# ============================================================

OUT = (
    enriched_segments,     # 0
    post_station_data,     # 1
    module_station_data,   # 2
    summary                # 3
)
# ----------------------------------------
code_block_10 = CodeBlock(st=BARRIER_STATION_GENERATOR) { st[0]; st[1]; st[2]; st[3]; }
GEOMETRY_OFFSET_SAMPLER = Python(IN[0]=code_block_10.out0, IN[1]=filterByBoolMask.out, IN[2]=filterByBoolMask.in)  # CPython3
# ---------- GEOMETRY_OFFSET_SAMPLER.python (579 lines) ----------
# CPython3 - GEOMETRY_OFFSET_SAMPLER_V2
#
# IN[0] = Segment data from BARRIER_STATION_GENERATOR_V2
# IN[1] = LEFT ETW/EPS feature lines
# IN[2] = RIGHT ETW/EPS feature lines
#
# OUT[0] = Enriched SegmentData
# OUT[1] = Geometry station data
# OUT[2] = Post station data
# OUT[3] = Module station data
# OUT[4] = Warnings


segment_data = IN[0]
left_feature_lines_input = IN[1]
right_feature_lines_input = IN[2]


# ============================================================
# AUXILIARY FUNCTIONS
# ============================================================

def as_list(value):
    if value is None:
        return []

    if isinstance(value, (list, tuple)):
        result = []

        for item in value:
            if isinstance(item, (list, tuple)):
                result.extend(as_list(item))
            else:
                result.append(item)

        return result

    return [value]


def clean_text(value):
    if value is None:
        return ""

    return str(value).strip()


def to_number(value):
    if value is None:
        return None

    if isinstance(value, (int, float)):
        return float(value)

    text = str(value).strip().replace(" ", "")
    text = text.replace("+", "")

    if "," in text and "." not in text:
        text = text.replace(",", ".")

    try:
        return float(text)

    except:
        return None


def get_dict_value(dictionary, key):
    if dictionary is None:
        return None

    try:
        if isinstance(dictionary, dict):
            return dictionary.get(key)

        if hasattr(dictionary, "ValueAtKey"):
            return dictionary.ValueAtKey(key)

        return dictionary[key]

    except:
        return None


def copy_dictionary(dictionary):
    if dictionary is None:
        return {}

    if isinstance(dictionary, dict):
        return dict(dictionary)

    result = {}

    try:
        for key in dictionary.Keys:
            result[str(key)] = dictionary.ValueAtKey(key)

    except:
        pass

    return result


def get_result_value(result, key):
    if result is None:
        return None

    try:
        if isinstance(result, dict):
            return result.get(key)

        if hasattr(result, "ValueAtKey"):
            return result.ValueAtKey(key)

        return result[key]

    except:
        return None


def feature_line_name(feature_line):
    try:
        return str(feature_line)

    except:
        return "CorridorFeatureLine"


# ============================================================
# SOLVE ONE STATION
# ============================================================

def solve_station(
    station,
    side,
    section_offset,
    feature_lines
):

    candidates = []

    for line_index, feature_line in enumerate(feature_lines):

        if feature_line is None:
            continue

        try:

            result = feature_line.OffsetElevationByStation(
                station
            )

            reference_offset = to_number(
                get_result_value(
                    result,
                    "Offset"
                )
            )

            elevation = to_number(
                get_result_value(
                    result,
                    "Elevation"
                )
            )

            if reference_offset is None:
                continue


            # -----------------------------------------------
            # Respect expected geometric side
            # -----------------------------------------------

            if (
                side == "LEFT"
                and reference_offset >= 0
            ):
                continue

            if (
                side == "RIGHT"
                and reference_offset <= 0
            ):
                continue


            candidates.append({

                "ReferenceOffset":
                    reference_offset,

                "ReferenceElevation":
                    elevation,

                "ReferenceFeatureLine":
                    feature_line_name(
                        feature_line
                    ),

                "ReferenceLineIndex":
                    line_index
            })


        except:
            continue


    # --------------------------------------------------------
    # No ETW/EPS available
    # --------------------------------------------------------

    if len(candidates) == 0:
        return None


    # --------------------------------------------------------
    # Select outermost ETW/EPS
    # --------------------------------------------------------

    selected = max(
        candidates,
        key=lambda item:
            abs(item["ReferenceOffset"])
    )


    reference_offset = (
        selected["ReferenceOffset"]
    )


    # --------------------------------------------------------
    # Apply additional SectionOffset outward
    # --------------------------------------------------------

    if side == "LEFT":

        final_offset = (
            reference_offset
            - abs(section_offset)
        )

    else:

        final_offset = (
            reference_offset
            + abs(section_offset)
        )


    return {

        "Station":
            station,

        "ReferenceOffset":
            reference_offset,

        "ReferenceElevation":
            selected["ReferenceElevation"],

        "SectionOffset":
            section_offset,

        "FinalOffset":
            final_offset,

        "ReferenceFeatureLine":
            selected["ReferenceFeatureLine"],

        "ReferenceLineIndex":
            selected["ReferenceLineIndex"]
    }


# ============================================================
# INPUTS
# ============================================================

segments = as_list(
    segment_data
)

left_feature_lines = as_list(
    left_feature_lines_input
)

right_feature_lines = as_list(
    right_feature_lines_input
)


# ============================================================
# OUTPUT COLLECTIONS
# ============================================================

enriched_segments = []

geometry_station_data = []

post_station_data = []

module_station_data = []

warnings = []


# ============================================================
# PROCESS SEGMENTS
# ============================================================

for segment in segments:

    segment_id = clean_text(
        get_dict_value(
            segment,
            "ID"
        )
    )

    parent_id = clean_text(
        get_dict_value(
            segment,
            "ParentID"
        )
    )

    side = clean_text(
        get_dict_value(
            segment,
            "Side"
        )
    ).upper()

    section_type = clean_text(
        get_dict_value(
            segment,
            "SectionType"
        )
    )

    section_offset = to_number(
        get_dict_value(
            segment,
            "SectionOffset"
        )
    )


    geometry_stations = as_list(
        get_dict_value(
            segment,
            "GeometryStations"
        )
    )

    post_stations = as_list(
        get_dict_value(
            segment,
            "PostStations"
        )
    )

    module_stations = as_list(
        get_dict_value(
            segment,
            "ModuleStations"
        )
    )


    # --------------------------------------------------------
    # Select Feature Lines by Side
    # --------------------------------------------------------

    if side == "LEFT":

        feature_lines = (
            left_feature_lines
        )

    elif side == "RIGHT":

        feature_lines = (
            right_feature_lines
        )

    else:

        warnings.append(
            "Segment '{}': invalid Side."
            .format(segment_id)
        )

        continue


    if section_offset is None:

        warnings.append(
            "Segment '{}': invalid SectionOffset."
            .format(segment_id)
        )

        continue


    # ========================================================
    # FUNCTION TO PROCESS A STATION COLLECTION
    # ========================================================

    def process_stations(
        stations,
        component_type
    ):

        results = []

        for station_value in stations:

            station = to_number(
                station_value
            )

            if station is None:
                continue


            solved = solve_station(
                station,
                side,
                section_offset,
                feature_lines
            )


            if solved is None:

                warnings.append(
                    "Segment '{}': no ETW/EPS reference "
                    "at {} station {}."
                    .format(
                        segment_id,
                        component_type,
                        station
                    )
                )

                continue


            solved["ID"] = segment_id

            solved["ParentID"] = parent_id

            solved["Side"] = side

            solved[
                "SectionType"
            ] = section_type

            solved[
                "ComponentType"
            ] = component_type


            results.append(
                solved
            )


        return results


    # ========================================================
    # GEOMETRY
    # ========================================================

    geometry_results = process_stations(
        geometry_stations,
        "GEOMETRY"
    )


    # ========================================================
    # POSTS
    # ========================================================

    post_results = process_stations(
        post_stations,
        "POST"
    )


    # ========================================================
    # MODULES
    # ========================================================

    module_results = process_stations(
        module_stations,
        "MODULE"
    )


    # ========================================================
    # FLAT OUTPUT LISTS
    # ========================================================

    geometry_station_data.extend(
        geometry_results
    )

    post_station_data.extend(
        post_results
    )

    module_station_data.extend(
        module_results
    )


    # ========================================================
    # ENRICH SEGMENT
    # ========================================================

    enriched = copy_dictionary(
        segment
    )

    enriched[
        "GeometryOffsetData"
    ] = geometry_results

    enriched[
        "PostOffsetData"
    ] = post_results

    enriched[
        "ModuleOffsetData"
    ] = module_results


    enriched[
        "ValidGeometryPointCount"
    ] = len(
        geometry_results
    )

    enriched[
        "ValidPostPointCount"
    ] = len(
        post_results
    )

    enriched[
        "ValidModulePointCount"
    ] = len(
        module_results
    )


    enriched_segments.append(
        enriched
    )


# ============================================================
# OUTPUT
# ============================================================

OUT = (
    enriched_segments,       # 0
    geometry_station_data,   # 1
    post_station_data,       # 2
    module_station_data,     # 3
    warnings                 # 4
)
# ----------------------------------------
code_block_11 = CodeBlock(geo=GEOMETRY_OFFSET_SAMPLER) { geo[0]; geo[1]; geo[2]; geo[3]; geo[4]; }
PREPARE_COORDINATE_INPUTS = Python(IN[0]=code_block_11.out1, IN[1]=code_block_11.out2, IN[2]=code_block_11.out3)  # CPython3
# ---------- PREPARE_COORDINATE_INPUTS.python (205 lines) ----------
# CPython3 - PREPARE_COORDINATE_INPUTS_V2
#
# IN[0] = Geometry station data
# IN[1] = Post station data
# IN[2] = Module station data
#
# OUT[0:3]   Geometry
# OUT[4:7]   Posts
# OUT[8:11]  Modules


geometry_data = IN[0]
post_data = IN[1]
module_data = IN[2]


def as_list(value):
    if value is None:
        return []

    if isinstance(value, (list, tuple)):
        result = []

        for item in value:
            if isinstance(item, (list, tuple)):
                result.extend(as_list(item))
            else:
                result.append(item)

        return result

    return [value]


def get_value(dictionary, key):
    if dictionary is None:
        return None

    try:
        if isinstance(dictionary, dict):
            return dictionary.get(key)

        if hasattr(dictionary, "ValueAtKey"):
            return dictionary.ValueAtKey(key)

        return dictionary[key]

    except:
        return None


def to_number(value):
    if value is None:
        return None

    if isinstance(value, (int, float)):
        return float(value)

    try:
        return float(
            str(value).strip().replace(",", ".")
        )

    except:
        return None


def extract(data):

    stations = []
    offsets = []
    elevations = []
    metadata = []

    for item in as_list(data):

        station = to_number(
            get_value(item, "Station")
        )

        final_offset = to_number(
            get_value(item, "FinalOffset")
        )

        elevation = to_number(
            get_value(item, "ReferenceElevation")
        )

        if (
            station is None
            or final_offset is None
            or elevation is None
        ):
            continue


        stations.append(
            station
        )

        offsets.append(
            final_offset
        )

        elevations.append(
            elevation
        )


        metadata.append({

            "ID":
                get_value(item, "ID"),

            "ParentID":
                get_value(item, "ParentID"),

            "Side":
                get_value(item, "Side"),

            "SectionType":
                get_value(item, "SectionType"),

            "ComponentType":
                get_value(item, "ComponentType"),

            "Station":
                station,

            "FinalOffset":
                final_offset,

            "ReferenceOffset":
                get_value(
                    item,
                    "ReferenceOffset"
                ),

            "ReferenceFeatureLine":
                get_value(
                    item,
                    "ReferenceFeatureLine"
                )
        })


    return (
        stations,
        offsets,
        elevations,
        metadata
    )


# ============================================================
# GEOMETRY
# ============================================================

g_sta, g_off, g_z, g_meta = extract(
    geometry_data
)


# ============================================================
# POSTS
# ============================================================

p_sta, p_off, p_z, p_meta = extract(
    post_data
)


# ============================================================
# MODULES
# ============================================================

m_sta, m_off, m_z, m_meta = extract(
    module_data
)


# ============================================================
# OUTPUT
# ============================================================

OUT = (

    # GEOMETRY
    g_sta,    # 0
    g_off,    # 1
    g_z,      # 2
    g_meta,   # 3

    # POSTS
    p_sta,    # 4
    p_off,    # 5
    p_z,      # 6
    p_meta,   # 7

    # MODULES
    m_sta,    # 8
    m_off,    # 9
    m_z,      # 10
    m_meta    # 11
)
# ----------------------------------------
code_block_12 = CodeBlock(coord=PREPARE_COORDINATE_INPUTS)
# ---------- code_block_12.designscript (12 lines) ----------
coord[0];
coord[1];
coord[2];
coord[3];
coord[4];
coord[5];
coord[6];
coord[7];
coord[8];
coord[9];
coord[10];
coord[11];
# ----------------------------------------

# group: BARRIER_LINEAR_GEOMETRY
coordinateSystemByStationOffset = Autodesk.Civil.DynamoNodes.Alignment.CoordinateSystemByStationOffset(alignment=alignment, station=code_block_12.out0@L1, offset=code_block_12.out1@L1)
origin = CoordinateSystem.Origin(coordinateSystem=coordinateSystemByStationOffset)
X = Point.X(point=origin)
Y = Point.Y(point=origin)
byCoordinates = Point.ByCoordinates(x=X, y=Y, z=code_block_12.out2)
code_block_13 = CodeBlock { 1; }
flatten_2 = List.Flatten(list=byCoordinates, amount=code_block_13)
GROUP_POINTS_BY_SEGMENT = Python(IN[0]=flatten_2, IN[1]=code_block_10.out3)  # CPython3
# ---------- GROUP_POINTS_BY_SEGMENT.python (251 lines) ----------
# CPython3 - GROUP_POINTS_BY_SEGMENT
#
# PURPOSE:
# Rebuilds the point list structure using the GeometryPointCount
# stored for each barrier segment.
#
# IN[0] = Flat geometry point list
# IN[1] = Segment summary from BARRIER_STATION_GENERATOR
#
# OUT[0] = Points grouped by segment
# OUT[1] = Segment information
# OUT[2] = Invalid segments
# OUT[3] = Warnings


points_input = IN[0]
summary_input = IN[1]


# ============================================================
# AUXILIARY FUNCTIONS
# ============================================================

def as_list(value):
    if value is None:
        return []

    if isinstance(value, (list, tuple)):
        result = []

        for item in value:
            if isinstance(item, (list, tuple)):
                result.extend(as_list(item))
            else:
                result.append(item)

        return result

    return [value]


def get_value(dictionary, key):
    if dictionary is None:
        return None

    try:
        if isinstance(dictionary, dict):
            return dictionary.get(key)

        if hasattr(dictionary, "ValueAtKey"):
            return dictionary.ValueAtKey(key)

        return dictionary[key]

    except Exception:
        return None


def to_integer(value):
    if value is None:
        return None

    try:
        return int(round(float(value)))
    except Exception:
        return None


def clean_text(value):
    if value is None:
        return ""

    return str(value).strip()


# ============================================================
# PREPARE INPUTS
# ============================================================

points = as_list(points_input)
summary = as_list(summary_input)

grouped_points = []
segment_information = []
invalid_segments = []
warnings = []


# ============================================================
# REBUILD POINT GROUPS
# ============================================================

cursor = 0


for index, item in enumerate(summary):

    segment_id = clean_text(
        get_value(item, "ID")
    )

    start_station = get_value(
        item,
        "StartStation"
    )

    end_station = get_value(
        item,
        "EndStation"
    )

    geometry_point_count = to_integer(
        get_value(
            item,
            "GeometryPointCount"
        )
    )


    # --------------------------------------------------------
    # Validate point count
    # --------------------------------------------------------

    if geometry_point_count is None:

        invalid_segments.append({
            "ID": segment_id,
            "Reason":
                "GeometryPointCount is missing or invalid."
        })

        continue


    if geometry_point_count < 2:

        invalid_segments.append({
            "ID": segment_id,
            "Reason":
                "At least 2 points are required to create a curve."
        })

        continue


    # --------------------------------------------------------
    # Calculate slice
    # --------------------------------------------------------

    start_index = cursor

    end_index = (
        cursor + geometry_point_count
    )


    if end_index > len(points):

        invalid_segments.append({
            "ID": segment_id,
            "ExpectedPoints":
                geometry_point_count,

            "AvailablePoints":
                max(0, len(points) - cursor),

            "Reason":
                "Not enough geometry points are available."
        })

        warnings.append(
            "Segment '{}': expected {} points, "
            "but only {} points remain."
            .format(
                segment_id,
                geometry_point_count,
                max(0, len(points) - cursor)
            )
        )

        break


    segment_points = points[
        start_index:end_index
    ]


    grouped_points.append(
        segment_points
    )


    segment_information.append({

        "ID":
            segment_id,

        "StartStation":
            start_station,

        "EndStation":
            end_station,

        "PointCount":
            len(segment_points),

        "StartPointIndex":
            start_index,

        "EndPointIndex":
            end_index - 1
    })


    cursor = end_index


# ============================================================
# FINAL CONSISTENCY CHECK
# ============================================================

if cursor < len(points):

    warnings.append(
        "{} geometry points were not assigned "
        "to any barrier segment."
        .format(
            len(points) - cursor
        )
    )


elif cursor > len(points):

    warnings.append(
        "The requested segment point counts exceed "
        "the available geometry point count."
    )


# ============================================================
# OUTPUTS
# ============================================================

OUT = (
    grouped_points,          # 0
    segment_information,     # 1
    invalid_segments,        # 2
    warnings                 # 3
)
# ----------------------------------------
code_block_14 = CodeBlock(grp=GROUP_POINTS_BY_SEGMENT) { grp[0]; grp[1]; grp[2]; grp[3]; }
boolean = BoolSelector(false)
byPoints = PolyCurve.ByPoints(points=code_block_14.out0, connectLastToFirst=boolean)
COMPONENT_BLOCK_SELECTOR = Python(IN[0]=code_block_11.out0, IN[1]=code_block_12.out7, IN[2]=code_block_12.out11)  # CPython3
# ---------- COMPONENT_BLOCK_SELECTOR.python (323 lines) ----------
# CPython3 - COMPONENT_BLOCK_SELECTOR
#
# IN[0] = Enriched SegmentData
# IN[1] = Post metadata
# IN[2] = Module metadata
#
# OUT[0] = Post block names aligned with post points
# OUT[1] = Module block names aligned with module points
# OUT[2] = Linear block information by segment
# OUT[3] = Warnings


segment_data = IN[0]
post_metadata = IN[1]
module_metadata = IN[2]


# ============================================================
# AUXILIARY FUNCTIONS
# ============================================================

def as_list(value):
    if value is None:
        return []

    if isinstance(value, (list, tuple)):
        result = []

        for item in value:
            if isinstance(item, (list, tuple)):
                result.extend(as_list(item))
            else:
                result.append(item)

        return result

    return [value]


def get_value(dictionary, key):
    if dictionary is None:
        return None

    try:
        if isinstance(dictionary, dict):
            return dictionary.get(key)

        if hasattr(dictionary, "ValueAtKey"):
            return dictionary.ValueAtKey(key)

        return dictionary[key]

    except:
        return None


def clean_text(value):
    if value is None:
        return ""

    return str(value).strip()


# ============================================================
# INPUTS
# ============================================================

segments = as_list(segment_data)
post_meta = as_list(post_metadata)
module_meta = as_list(module_metadata)

warnings = []


# ============================================================
# BUILD SEGMENT LOOKUP
#
# ID → component properties
# ============================================================

segment_lookup = {}


for segment in segments:

    segment_id = clean_text(
        get_value(segment, "ID")
    )

    parent_data = get_value(
        segment,
        "ParentData"
    )

    if segment_id == "":
        continue


    block_post = clean_text(
        get_value(
            parent_data,
            "BlockPost"
        )
    )

    block_linear = clean_text(
        get_value(
            parent_data,
            "BlockLinear"
        )
    )

    barrier_type = clean_text(
        get_value(
            parent_data,
            "Type"
        )
    )

    post_spacing = get_value(
        parent_data,
        "PostSpacing"
    )

    module_length = get_value(
        parent_data,
        "ModuleLength"
    )


    segment_lookup[segment_id] = {

        "BlockPost":
            block_post,

        "BlockLinear":
            block_linear,

        "Type":
            barrier_type,

        "PostSpacing":
            post_spacing,

        "ModuleLength":
            module_length
    }


# ============================================================
# POSTS
# ============================================================

post_block_names = []


for item in post_meta:

    segment_id = clean_text(
        get_value(item, "ID")
    )

    info = segment_lookup.get(
        segment_id
    )


    if info is None:

        post_block_names.append("")

        warnings.append(
            "Post point for segment '{}' has no segment data."
            .format(segment_id)
        )

        continue


    block_name = info[
        "BlockPost"
    ]


    if block_name == "":

        warnings.append(
            "Segment '{}' generates posts but BlockPost is empty."
            .format(segment_id)
        )


    post_block_names.append(
        block_name
    )


# ============================================================
# MODULES
#
# For modular systems such as New Jersey we use BlockLinear
# as the block representing each repeated module.
# ============================================================

module_block_names = []


for item in module_meta:

    segment_id = clean_text(
        get_value(item, "ID")
    )

    info = segment_lookup.get(
        segment_id
    )


    if info is None:

        module_block_names.append("")

        warnings.append(
            "Module point for segment '{}' has no segment data."
            .format(segment_id)
        )

        continue


    block_name = info[
        "BlockLinear"
    ]


    if block_name == "":

        warnings.append(
            "Segment '{}' generates modules but BlockLinear is empty."
            .format(segment_id)
        )


    module_block_names.append(
        block_name
    )


# ============================================================
# LINEAR ELEMENT DATA
#
# One record per barrier segment.
# Used later for longitudinal bionda / cable / tubular element.
# ============================================================

linear_block_data = []


for segment in segments:

    segment_id = clean_text(
        get_value(segment, "ID")
    )

    parent_id = clean_text(
        get_value(segment, "ParentID")
    )

    parent_data = get_value(
        segment,
        "ParentData"
    )


    block_linear = clean_text(
        get_value(
            parent_data,
            "BlockLinear"
        )
    )

    barrier_type = clean_text(
        get_value(
            parent_data,
            "Type"
        )
    )

    module_length = get_value(
        parent_data,
        "ModuleLength"
    )


    linear_block_data.append({

        "ID":
            segment_id,

        "ParentID":
            parent_id,

        "Type":
            barrier_type,

        "BlockLinear":
            block_linear,

        "ModuleLength":
            module_length
    })


# ============================================================
# OUTPUT
# ============================================================

OUT = (
    post_block_names,     # 0
    module_block_names,   # 1
    linear_block_data,    # 2
    warnings              # 3
)
# ----------------------------------------
code_block_15 = CodeBlock(comp=COMPONENT_BLOCK_SELECTOR) { comp[0]; comp[1]; comp[2]; comp[3]; }
BLOCK_PATH_RESOLVER = Python(IN[0]=barrier_block_library, IN[1]=code_block_15.out0, IN[2]=code_block_15.out1)  # CPython3
# ---------- BLOCK_PATH_RESOLVER.python (201 lines) ----------
# CPython3 - BLOCK_PATH_RESOLVER
#
# IN[0] = Base block directory
# IN[1] = Post block names
# IN[2] = Module block names
#
# OUT[0] = Full DWG paths for posts
# OUT[1] = Full DWG paths for modules
# OUT[2] = Missing files
# OUT[3] = Warnings

import os

base_directory = IN[0]
post_names_input = IN[1]
module_names_input = IN[2]


def as_list(value):
    if value is None:
        return []

    if isinstance(value, (list, tuple)):
        result = []
        for item in value:
            if isinstance(item, (list, tuple)):
                result.extend(as_list(item))
            else:
                result.append(item)
        return result

    return [value]


def clean_text(value):
    if value is None:
        return ""
    return str(value).strip()


def resolve_directory(value):
    """
    Handles normal string paths and Dynamo file/directory objects.
    """
    if value is None:
        return ""

    try:
        if hasattr(value, "DirectoryName"):
            return clean_text(value.DirectoryName)
    except:
        pass

    try:
        if hasattr(value, "FullName"):
            return clean_text(value.FullName)
    except:
        pass

    return clean_text(value)


def normalize_block_name(value):
    name = clean_text(value)

    if name == "":
        return ""

    if name.lower().endswith(".dwg"):
        return name

    return name + ".dwg"


def build_paths(names, base_dir, component_type):

    paths = []
    missing = []
    warnings = []

    for index, value in enumerate(names):

        block_name = normalize_block_name(value)

        if block_name == "":
            paths.append(None)

            warnings.append(
                "{} item {} has an empty BlockName."
                .format(component_type, index)
            )

            continue

        full_path = os.path.normpath(
            os.path.join(
                base_dir,
                block_name
            )
        )

        paths.append(full_path)

        if not os.path.isfile(full_path):

            missing.append({
                "ComponentType": component_type,
                "Index": index,
                "BlockName": block_name,
                "Path": full_path
            })

    return paths, missing, warnings


# ============================================================
# PREPARE INPUTS
# ============================================================

base_dir = resolve_directory(
    base_directory
)

post_names = as_list(
    post_names_input
)

module_names = as_list(
    module_names_input
)

missing_files = []
warnings = []


# ============================================================
# VALIDATE BASE DIRECTORY
# ============================================================

if base_dir == "":

    warnings.append(
        "Barrier block directory is empty."
    )

elif not os.path.isdir(base_dir):

    warnings.append(
        "Barrier block directory does not exist: {}"
        .format(base_dir)
    )


# ============================================================
# POSTS
# ============================================================

post_paths, post_missing, post_warnings = build_paths(
    post_names,
    base_dir,
    "POST"
)

missing_files.extend(
    post_missing
)

warnings.extend(
    post_warnings
)


# ============================================================
# MODULES
# ============================================================

module_paths, module_missing, module_warnings = build_paths(
    module_names,
    base_dir,
    "MODULE"
)

missing_files.extend(
    module_missing
)

warnings.extend(
    module_warnings
)


# ============================================================
# OUTPUT
# ============================================================

OUT = (
    post_paths,      # 0
    module_paths,    # 1
    missing_files,   # 2
    warnings         # 3
)
# ----------------------------------------
code_block_16 = CodeBlock(path=BLOCK_PATH_RESOLVER) { path[0]; path[1]; path[2]; path[3]; }

# group: BARRIER_POSTS
coordinateSystemByStationOffset_2 = Autodesk.Civil.DynamoNodes.Alignment.CoordinateSystemByStationOffset(alignment=alignment, station=code_block_12.out4@L1, offset=code_block_12.out5@L1)
origin_2 = CoordinateSystem.Origin(coordinateSystem=coordinateSystemByStationOffset_2)
X_2 = Point.X(point=origin_2)
Y_2 = Point.Y(point=origin_2)
byCoordinates_2 = Point.ByCoordinates(x=X_2, y=Y_2, z=code_block_12.out6)
flatten_3 = List.Flatten(list=byCoordinates_2, amount=code_block_13)
POST_ORIENTATION_GENERATOR = Python(IN[0]=coordinateSystemByStationOffset_2, IN[1]=code_block_12.out7)  # CPython3
# ---------- POST_ORIENTATION_GENERATOR.python (355 lines) ----------
# ============================================================
# POST_ORIENTATION_GENERATOR_V2
# CPython3 - Dynamo / Civil 3D
#
# PURPOSE
# Calculates the rotation of vertical barrier components
# (posts, plates and bolts) according to alignment direction
# and barrier side.
#
# BLOCK STANDARD:
# BLOCK_POST_BM_STD is modeled in its base orientation.
#
# RIGHT → tangent + 90°  (counterclockwise)
# LEFT  → tangent - 90°  (clockwise)
#
# IN[0] = CoordinateSystems at post positions
# IN[1] = Post Metadata
#
# OUT[0] = Rotation angles [radians]
# OUT[1] = Orientation metadata
# OUT[2] = Warnings
# ============================================================

import math


# ============================================================
# INPUTS
# ============================================================

coordinate_systems_input = IN[0]
post_metadata_input = IN[1]


# ============================================================
# AUXILIARY FUNCTIONS
# ============================================================

def as_list(value):

    if value is None:
        return []

    if isinstance(value, (list, tuple)):

        result = []

        for item in value:

            if isinstance(item, (list, tuple)):
                result.extend(as_list(item))

            else:
                result.append(item)

        return result

    return [value]


def get_value(dictionary, key):

    if dictionary is None:
        return None

    try:

        if isinstance(dictionary, dict):
            return dictionary.get(key)

        if hasattr(dictionary, "ValueAtKey"):
            return dictionary.ValueAtKey(key)

        return dictionary[key]

    except:
        return None


def clean_text(value):

    if value is None:
        return ""

    return str(value).strip()


def normalize_angle(angle):

    """
    Normalizes angle between 0 and 2*pi.
    """

    return angle % (2.0 * math.pi)


# ============================================================
# PREPARE INPUTS
# ============================================================

coordinate_systems = as_list(
    coordinate_systems_input
)

post_metadata = as_list(
    post_metadata_input
)


# ============================================================
# OUTPUT COLLECTIONS
# ============================================================

rotation_angles = []
orientation_data = []
warnings = []


# ============================================================
# CHECK LIST LENGTH
# ============================================================

count = min(
    len(coordinate_systems),
    len(post_metadata)
)


if len(coordinate_systems) != len(post_metadata):

    warnings.append(
        "CoordinateSystem count ({}) differs from "
        "Post Metadata count ({})."
        .format(
            len(coordinate_systems),
            len(post_metadata)
        )
    )


# ============================================================
# PROCESS POSTS
# ============================================================

for index in range(count):

    cs = coordinate_systems[index]
    meta = post_metadata[index]


    # --------------------------------------------------------
    # METADATA
    # --------------------------------------------------------

    segment_id = clean_text(
        get_value(
            meta,
            "ID"
        )
    )

    parent_id = clean_text(
        get_value(
            meta,
            "ParentID"
        )
    )

    station = get_value(
        meta,
        "Station"
    )

    side = clean_text(
        get_value(
            meta,
            "Side"
        )
    ).upper()

    section_type = clean_text(
        get_value(
            meta,
            "SectionType"
        )
    )


    # --------------------------------------------------------
    # VALIDATE SIDE
    # --------------------------------------------------------

    if side not in [
        "LEFT",
        "RIGHT"
    ]:

        rotation_angles.append(
            None
        )

        warnings.append(
            "Post {} | Segment '{}': invalid Side '{}'."
            .format(
                index,
                segment_id,
                side
            )
        )

        continue


    try:

        # ====================================================
        # ALIGNMENT TANGENT
        # ====================================================

        x_axis = cs.XAxis

        x = float(
            x_axis.X
        )

        y = float(
            x_axis.Y
        )


        tangent_angle = math.atan2(
            y,
            x
        )


        # ====================================================
        # POST ORIENTATION
        #
        # RIGHT
        #   +90 degrees counterclockwise
        #
        # LEFT
        #   -90 degrees clockwise
        # ====================================================

        if side == "RIGHT":

            rotation_angle = (
                tangent_angle
                + math.pi / 2.0
            )


        elif side == "LEFT":

            rotation_angle = (
                tangent_angle
                - math.pi / 2.0
            )


        # ====================================================
        # NORMALIZE ANGLE
        # ====================================================

        rotation_angle = normalize_angle(
            rotation_angle
        )


        # ====================================================
        # OUTPUT ANGLE
        # ====================================================

        rotation_angles.append(
            rotation_angle
        )


        # ====================================================
        # ENRICHED METADATA
        # ====================================================

        orientation_data.append({

            "PostIndex":
                index,

            "ID":
                segment_id,

            "ParentID":
                parent_id,

            "Station":
                station,

            "Side":
                side,

            "SectionType":
                section_type,

            "TangentAngle":
                tangent_angle,

            "TangentAngleDeg":
                math.degrees(
                    tangent_angle
                ),

            "RotationAngle":
                rotation_angle,

            "RotationAngleDeg":
                math.degrees(
                    rotation_angle
                ),

            "RotationRule":
                (
                    "Tangent + 90 deg CCW"
                    if side == "RIGHT"
                    else
                    "Tangent - 90 deg CW"
                )
        })


    except Exception as error:

        rotation_angles.append(
            None
        )

        warnings.append(
            "Post {} | Segment '{}': {}"
            .format(
                index,
                segment_id,
                str(error)
            )
        )


# ============================================================
# OUTPUT
# ============================================================

OUT = (
    rotation_angles,      # 0
    orientation_data,     # 1
    warnings              # 2
)
# ----------------------------------------
code_block_17 = CodeBlock(rot=POST_ORIENTATION_GENERATOR) { rot[0]; rot[1]; rot[2]; }
max_value = CodeBlock { 0; }
INSERT_BARRIER_POSTS = Python(IN[0]=flatten_3, IN[1]=code_block_16.out0, IN[2]=code_block_17.out0, IN[3]=code_block_12.out7, IN[4]=max_value)  # CPython3
# ---------- INSERT_BARRIER_POSTS.python (537 lines) ----------
# ============================================================
# INSERT_BARRIER_POSTS_V2
# CPython3 - Civil 3D / AutoCAD
#
# IN[0] = Post Points
# IN[1] = Post DWG Paths
# IN[2] = Rotation Angles [radians]
# IN[3] = Post Metadata
# IN[4] = MaxCount
#         0 = ALL
#
# OUT[0] = Inserted objects metadata
# OUT[1] = Handles
# OUT[2] = Errors
# OUT[3] = Summary
# ============================================================

import clr
import os

clr.AddReference("AcMgd")
clr.AddReference("AcDbMgd")
clr.AddReference("AcCoreMgd")

from Autodesk.AutoCAD.ApplicationServices import Application

from Autodesk.AutoCAD.DatabaseServices import (
    BlockTableRecord,
    BlockReference,
    Database,
    OpenMode,
    FileOpenMode
)

from Autodesk.AutoCAD.Geometry import Point3d


# ============================================================
# INPUTS
# ============================================================

points_input = IN[0]
paths_input = IN[1]
rotations_input = IN[2]
metadata_input = IN[3]
max_count_input = IN[4]


# ============================================================
# HELPERS
# ============================================================

def as_list(value):

    if value is None:
        return []

    if isinstance(value, (list, tuple)):

        result = []

        for item in value:

            if isinstance(item, (list, tuple)):
                result.extend(as_list(item))

            else:
                result.append(item)

        return result

    return [value]


def clean_text(value):

    if value is None:
        return ""

    return str(value).strip()


def get_value(dictionary, key):

    if dictionary is None:
        return None

    try:

        if isinstance(dictionary, dict):
            return dictionary.get(key)

        if hasattr(dictionary, "ValueAtKey"):
            return dictionary.ValueAtKey(key)

        return dictionary[key]

    except:
        return None


def to_int(value, default=0):

    try:
        return int(value)

    except:
        return default


def point_xyz(point):

    try:

        return (
            float(point.X),
            float(point.Y),
            float(point.Z)
        )

    except:
        return None


# ============================================================
# PREPARE LISTS
# ============================================================

points = as_list(points_input)
paths = as_list(paths_input)
rotations = as_list(rotations_input)
metadata = as_list(metadata_input)

max_count = to_int(
    max_count_input,
    0
)


available_count = min(
    len(points),
    len(paths),
    len(rotations),
    len(metadata)
)


if max_count > 0:

    process_count = min(
        available_count,
        max_count
    )

else:

    process_count = available_count


# ============================================================
# OUTPUT
# ============================================================

inserted_data = []
handles = []
errors = []


# ============================================================
# AUTOCAD DOCUMENT
# ============================================================

doc = Application.DocumentManager.MdiActiveDocument
db = doc.Database

doc_lock = None
transaction = None


try:

    # --------------------------------------------------------
    # LOCK DOCUMENT
    # --------------------------------------------------------

    doc_lock = doc.LockDocument()


    # --------------------------------------------------------
    # START TRANSACTION
    # --------------------------------------------------------

    transaction = (
        db.TransactionManager.StartTransaction()
    )


    # --------------------------------------------------------
    # BLOCK TABLE
    # --------------------------------------------------------

    block_table = transaction.GetObject(
        db.BlockTableId,
        OpenMode.ForRead
    )


    # IMPORTANT:
    # get_Item() is safer than [] with CPython3
    model_space_id = block_table.get_Item(
        BlockTableRecord.ModelSpace
    )


    model_space = transaction.GetObject(
        model_space_id,
        OpenMode.ForWrite
    )


    # ========================================================
    # INSERT POSTS
    # ========================================================

    for index in range(process_count):

        point = points[index]

        path = clean_text(
            paths[index]
        )

        meta = metadata[index]


        # ----------------------------------------------------
        # METADATA
        # ----------------------------------------------------

        segment_id = clean_text(
            get_value(meta, "ID")
        )

        parent_id = clean_text(
            get_value(meta, "ParentID")
        )

        station = get_value(
            meta,
            "Station"
        )

        side = clean_text(
            get_value(meta, "Side")
        )

        section_type = clean_text(
            get_value(meta, "SectionType")
        )


        # ----------------------------------------------------
        # POINT
        # ----------------------------------------------------

        xyz = point_xyz(point)

        if xyz is None:

            errors.append({

                "Index": index,
                "ID": segment_id,
                "Reason": "Invalid insertion point"
            })

            continue


        # ----------------------------------------------------
        # DWG PATH
        # ----------------------------------------------------

        if path == "" or not os.path.isfile(path):

            errors.append({

                "Index": index,
                "ID": segment_id,
                "Path": path,
                "Reason": "DWG file not found"
            })

            continue


        # ----------------------------------------------------
        # ROTATION
        # ----------------------------------------------------

        try:

            rotation = float(
                rotations[index]
            )

        except:

            errors.append({

                "Index": index,
                "ID": segment_id,
                "Reason": "Invalid rotation"
            })

            continue


        # ----------------------------------------------------
        # BLOCK NAME
        # ----------------------------------------------------

        block_name = os.path.splitext(
            os.path.basename(path)
        )[0]


        # ----------------------------------------------------
        # GET OR LOAD BLOCK DEFINITION
        # ----------------------------------------------------

        if block_table.Has(block_name):

            block_id = block_table.get_Item(
                block_name
            )


        else:

            source_db = Database(
                False,
                True
            )

            try:

                source_db.ReadDwgFile(
                    path,
                    FileOpenMode.OpenForReadAndAllShare,
                    True,
                    ""
                )


                block_id = db.Insert(
                    block_name,
                    source_db,
                    False
                )


            finally:

                source_db.Dispose()


        # ----------------------------------------------------
        # INSERT BLOCK
        # ----------------------------------------------------

        insertion_point = Point3d(
            xyz[0],
            xyz[1],
            xyz[2]
        )


        block_ref = BlockReference(
            insertion_point,
            block_id
        )


        block_ref.Rotation = rotation


        model_space.AppendEntity(
            block_ref
        )


        transaction.AddNewlyCreatedDBObject(
            block_ref,
            True
        )


        # ----------------------------------------------------
        # IDENTIFIERS
        # ----------------------------------------------------

        handle = str(
            block_ref.Handle
        )

        object_id = str(
            block_ref.ObjectId
        )


        handles.append(
            handle
        )


        inserted_data.append({

            "ComponentType":
                "POST",

            "Index":
                index,

            "ObjectId":
                object_id,

            "Handle":
                handle,

            "ID":
                segment_id,

            "ParentID":
                parent_id,

            "Station":
                station,

            "Side":
                side,

            "SectionType":
                section_type,

            "BlockName":
                block_name,

            "BlockPath":
                path,

            "Rotation":
                rotation,

            "X":
                xyz[0],

            "Y":
                xyz[1],

            "Z":
                xyz[2]
        })


    # --------------------------------------------------------
    # COMMIT
    # --------------------------------------------------------

    transaction.Commit()


except Exception as ex:

    if transaction is not None:

        try:
            transaction.Abort()
        except:
            pass


    errors.append({

        "GeneralError":
            str(ex)
    })


finally:

    if transaction is not None:

        try:
            transaction.Dispose()
        except:
            pass


    if doc_lock is not None:

        try:
            doc_lock.Dispose()
        except:
            pass


# ============================================================
# SUMMARY
# ============================================================

summary = {

    "AvailableItems":
        available_count,

    "RequestedItems":
        process_count,

    "CreatedItems":
        len(inserted_data),

    "ErrorCount":
        len(errors)
}


# ============================================================
# OUTPUT
# ============================================================

OUT = (
    inserted_data,    # 0
    handles,          # 1
    errors,           # 2
    summary           # 3
)
# ----------------------------------------
code_block_18 = CodeBlock(ins=INSERT_BARRIER_POSTS) { ins[0]; ins[1]; ins[2]; ins[3]; }

# group: BARRIER_LINEAR_MODULES
coordinateSystemByStationOffset_3 = Autodesk.Civil.DynamoNodes.Alignment.CoordinateSystemByStationOffset(alignment=alignment, station=code_block_12.out8@L1, offset=code_block_12.out9@L1)
origin_3 = CoordinateSystem.Origin(coordinateSystem=coordinateSystemByStationOffset_3)
X_3 = Point.X(point=origin_3)
Y_3 = Point.Y(point=origin_3)
byCoordinates_3 = Point.ByCoordinates(x=X_3, y=Y_3, z=code_block_12.out10)
code_block_19 = CodeBlock { 1; }
flatten_4 = List.Flatten(list=byCoordinates_3, amount=code_block_19)
LINEAR_ORIENTATION_GENERATOR = Python(IN[0]=coordinateSystemByStationOffset_3, IN[1]=code_block_12.out11)  # CPython3
# ---------- LINEAR_ORIENTATION_GENERATOR.python (219 lines) ----------
# CPython3 - LINEAR_ORIENTATION_GENERATOR
#
# IN[0] = CoordinateSystems for linear modules
# IN[1] = Module metadata
#
# OUT[0] = Rotation angles in radians
# OUT[1] = Linear orientation metadata
# OUT[2] = Warnings

import math

coordinate_systems_input = IN[0]
module_metadata_input = IN[1]


def as_list(value):
    if value is None:
        return []

    if isinstance(value, (list, tuple)):
        result = []

        for item in value:
            if isinstance(item, (list, tuple)):
                result.extend(as_list(item))
            else:
                result.append(item)

        return result

    return [value]


def get_value(dictionary, key):
    if dictionary is None:
        return None

    try:
        if isinstance(dictionary, dict):
            return dictionary.get(key)

        if hasattr(dictionary, "ValueAtKey"):
            return dictionary.ValueAtKey(key)

        return dictionary[key]

    except:
        return None


def clean_text(value):
    if value is None:
        return ""

    return str(value).strip()


coordinate_systems = as_list(
    coordinate_systems_input
)

module_metadata = as_list(
    module_metadata_input
)


rotation_angles = []
orientation_data = []
warnings = []


count = min(
    len(coordinate_systems),
    len(module_metadata)
)


for index in range(count):

    cs = coordinate_systems[index]
    meta = module_metadata[index]

    segment_id = clean_text(
        get_value(meta, "ID")
    )

    parent_id = clean_text(
        get_value(meta, "ParentID")
    )

    station = get_value(
        meta,
        "Station"
    )

    side = clean_text(
        get_value(meta, "Side")
    ).upper()


    try:

        # --------------------------------------------
        # Local alignment tangent
        # --------------------------------------------

        x_axis = cs.XAxis

        x = float(x_axis.X)
        y = float(x_axis.Y)

        tangent_angle = math.atan2(
            y,
            x
        )


        # --------------------------------------------
        # IMPORTANT:
        #
        # Linear block was modeled pointing RIGHT.
        #
        # RIGHT:
        # block follows alignment tangent.
        #
        # LEFT:
        # block is reversed 180 degrees.
        # --------------------------------------------

        rotation_angle = tangent_angle


        if side == "LEFT":

            rotation_angle += math.pi


        # Normalize 0 → 2*pi

        rotation_angle = (
            rotation_angle
            % (2.0 * math.pi)
        )


        rotation_angles.append(
            rotation_angle
        )


        orientation_data.append({

            "ModuleIndex":
                index,

            "ID":
                segment_id,

            "ParentID":
                parent_id,

            "Station":
                station,

            "Side":
                side,

            "TangentAngle":
                tangent_angle,

            "RotationAngle":
                rotation_angle
        })


    except Exception as error:

        rotation_angles.append(
            None
        )

        warnings.append(
            "Linear module {} | Segment '{}': {}"
            .format(
                index,
                segment_id,
                str(error)
            )
        )


# ============================================================
# COUNT CHECK
# ============================================================

if (
    len(coordinate_systems)
    != len(module_metadata)
):

    warnings.append(
        "CoordinateSystem count ({}) differs from "
        "Module metadata count ({})."
        .format(
            len(coordinate_systems),
            len(module_metadata)
        )
    )


# ============================================================
# OUTPUT
# ============================================================

OUT = (
    rotation_angles,     # 0
    orientation_data,    # 1
    warnings             # 2
)
# ----------------------------------------
code_block_20 = CodeBlock(linrot=LINEAR_ORIENTATION_GENERATOR) { linrot[0]; linrot[1]; linrot[2]; }
max_value_2 = CodeBlock { 0; }
INSERT_BARRIER_LINEAR = Python(IN[0]=flatten_4, IN[1]=code_block_16.out1, IN[2]=code_block_20.out0, IN[3]=code_block_12.out11, IN[4]=max_value_2)  # CPython3
# ---------- INSERT_BARRIER_LINEAR.python (896 lines) ----------
# ============================================================
# INSERT_BARRIER_LINEAR_V3
# CPython3 - Civil 3D / AutoCAD
#
# RELOADS BLOCK DEFINITIONS FROM DWG ON EVERY DYNAMO RUN
#
# IN[0] = Linear Module Points
# IN[1] = Linear DWG Paths
# IN[2] = Rotation Angles [radians]
# IN[3] = Module Metadata
# IN[4] = MaxCount
#         0 = ALL
#
# OUT[0] = Inserted objects metadata
# OUT[1] = Handles
# OUT[2] = Errors
# OUT[3] = Summary
# ============================================================

import clr
import os

clr.AddReference("AcMgd")
clr.AddReference("AcDbMgd")
clr.AddReference("AcCoreMgd")

from Autodesk.AutoCAD.ApplicationServices import Application

from Autodesk.AutoCAD.DatabaseServices import (
    BlockTableRecord,
    BlockReference,
    Database,
    OpenMode,
    FileOpenMode,
    ObjectIdCollection,
    IdMapping,
    DuplicateRecordCloning
)

from Autodesk.AutoCAD.Geometry import Point3d


# ============================================================
# INPUTS
# ============================================================

points_input = IN[0]
paths_input = IN[1]
rotations_input = IN[2]
metadata_input = IN[3]
max_count_input = IN[4]


# ============================================================
# AUXILIARY FUNCTIONS
# ============================================================

def as_list(value):

    if value is None:
        return []

    if isinstance(value, (list, tuple)):

        result = []

        for item in value:

            if isinstance(item, (list, tuple)):
                result.extend(as_list(item))

            else:
                result.append(item)

        return result

    return [value]


def clean_text(value):

    if value is None:
        return ""

    return str(value).strip()


def get_value(dictionary, key):

    if dictionary is None:
        return None

    try:

        if isinstance(dictionary, dict):
            return dictionary.get(key)

        if hasattr(dictionary, "ValueAtKey"):
            return dictionary.ValueAtKey(key)

        return dictionary[key]

    except:
        return None


def to_int(value, default=0):

    try:
        return int(value)

    except:
        return default


def point_xyz(point):

    try:

        return (
            float(point.X),
            float(point.Y),
            float(point.Z)
        )

    except:
        return None


# ============================================================
# BLOCK RELOAD FUNCTION
# ============================================================

def reload_existing_block(
    target_db,
    target_transaction,
    block_id,
    dwg_path
):

    """
    Replaces the geometry contained inside an existing block
    definition using the current contents of the external DWG.

    The BlockTableRecord ObjectId is preserved.

    Therefore, existing BlockReferences in the drawing should
    use the updated definition automatically.
    """

    source_db = Database(
        False,
        True
    )

    source_transaction = None

    try:

        # ----------------------------------------------------
        # READ CURRENT EXTERNAL DWG
        # ----------------------------------------------------

        source_db.ReadDwgFile(
            dwg_path,
            FileOpenMode.OpenForReadAndAllShare,
            True,
            ""
        )

        source_db.CloseInput(
            True
        )


        # ----------------------------------------------------
        # OPEN SOURCE DATABASE
        # ----------------------------------------------------

        source_transaction = (
            source_db.TransactionManager.StartTransaction()
        )

        source_block_table = (
            source_transaction.GetObject(
                source_db.BlockTableId,
                OpenMode.ForRead
            )
        )

        source_model_space_id = (
            source_block_table.get_Item(
                BlockTableRecord.ModelSpace
            )
        )

        source_model_space = (
            source_transaction.GetObject(
                source_model_space_id,
                OpenMode.ForRead
            )
        )


        # ----------------------------------------------------
        # OPEN EXISTING TARGET BLOCK
        # ----------------------------------------------------

        target_block = (
            target_transaction.GetObject(
                block_id,
                OpenMode.ForWrite
            )
        )


        # ----------------------------------------------------
        # REMOVE OLD GEOMETRY FROM BLOCK DEFINITION
        # ----------------------------------------------------

        old_ids = []

        for entity_id in target_block:

            old_ids.append(
                entity_id
            )


        for entity_id in old_ids:

            try:

                entity = (
                    target_transaction.GetObject(
                        entity_id,
                        OpenMode.ForWrite
                    )
                )

                entity.Erase()

            except:
                pass


        # ----------------------------------------------------
        # COLLECT NEW GEOMETRY FROM EXTERNAL DWG
        # ----------------------------------------------------

        source_ids = ObjectIdCollection()

        for entity_id in source_model_space:

            source_ids.Add(
                entity_id
            )


        # ----------------------------------------------------
        # CLONE NEW GEOMETRY INTO EXISTING BLOCK DEFINITION
        # ----------------------------------------------------

        if source_ids.Count > 0:

            id_mapping = IdMapping()

            source_db.WblockCloneObjects(
                source_ids,
                block_id,
                id_mapping,
                DuplicateRecordCloning.Replace,
                False
            )


        source_transaction.Commit()

        return True, ""


    except Exception as ex:

        if source_transaction is not None:

            try:
                source_transaction.Abort()
            except:
                pass

        return False, str(ex)


    finally:

        if source_transaction is not None:

            try:
                source_transaction.Dispose()
            except:
                pass

        try:
            source_db.Dispose()
        except:
            pass


# ============================================================
# PREPARE INPUT LISTS
# ============================================================

points = as_list(
    points_input
)

paths = as_list(
    paths_input
)

rotations = as_list(
    rotations_input
)

metadata = as_list(
    metadata_input
)


max_count = to_int(
    max_count_input,
    0
)


available_count = min(
    len(points),
    len(paths),
    len(rotations),
    len(metadata)
)


if max_count > 0:

    process_count = min(
        available_count,
        max_count
    )

else:

    process_count = available_count


# ============================================================
# OUTPUT COLLECTIONS
# ============================================================

inserted_data = []
handles = []
errors = []

reloaded_blocks = []
loaded_blocks = []


# Cache avoids reloading the same DWG hundreds of times
block_cache = {}


# ============================================================
# AUTOCAD DOCUMENT
# ============================================================

doc = (
    Application
    .DocumentManager
    .MdiActiveDocument
)

db = doc.Database

doc_lock = None
transaction = None


try:

    # ========================================================
    # LOCK CURRENT DRAWING
    # ========================================================

    doc_lock = doc.LockDocument()


    # ========================================================
    # START TRANSACTION
    # ========================================================

    transaction = (
        db.TransactionManager.StartTransaction()
    )


    # ========================================================
    # BLOCK TABLE
    # ========================================================

    block_table = (
        transaction.GetObject(
            db.BlockTableId,
            OpenMode.ForRead
        )
    )


    model_space_id = (
        block_table.get_Item(
            BlockTableRecord.ModelSpace
        )
    )


    model_space = (
        transaction.GetObject(
            model_space_id,
            OpenMode.ForWrite
        )
    )


    # ========================================================
    # PROCESS MODULES
    # ========================================================

    for index in range(process_count):

        point = points[index]

        path = clean_text(
            paths[index]
        )

        meta = metadata[index]


        # ----------------------------------------------------
        # METADATA
        # ----------------------------------------------------

        segment_id = clean_text(
            get_value(
                meta,
                "ID"
            )
        )

        parent_id = clean_text(
            get_value(
                meta,
                "ParentID"
            )
        )

        station = get_value(
            meta,
            "Station"
        )

        side = clean_text(
            get_value(
                meta,
                "Side"
            )
        )

        section_type = clean_text(
            get_value(
                meta,
                "SectionType"
            )
        )


        # ----------------------------------------------------
        # VALIDATE POINT
        # ----------------------------------------------------

        xyz = point_xyz(
            point
        )


        if xyz is None:

            errors.append({

                "Index":
                    index,

                "ID":
                    segment_id,

                "Reason":
                    "Invalid insertion point"
            })

            continue


        # ----------------------------------------------------
        # VALIDATE DWG PATH
        # ----------------------------------------------------

        if (
            path == ""
            or not os.path.isfile(path)
        ):

            errors.append({

                "Index":
                    index,

                "ID":
                    segment_id,

                "Path":
                    path,

                "Reason":
                    "DWG file not found"
            })

            continue


        # ----------------------------------------------------
        # ROTATION
        # ----------------------------------------------------

        try:

            rotation = float(
                rotations[index]
            )

        except:

            errors.append({

                "Index":
                    index,

                "ID":
                    segment_id,

                "Reason":
                    "Invalid rotation"
            })

            continue


        # ----------------------------------------------------
        # BLOCK NAME FROM DWG NAME
        # ----------------------------------------------------

        block_name = (
            os.path.splitext(
                os.path.basename(
                    path
                )
            )[0]
        )


        # ====================================================
        # LOAD / RELOAD BLOCK DEFINITION
        #
        # IMPORTANT:
        # Only once per unique BlockName per Dynamo execution.
        # ====================================================

        if block_name in block_cache:

            block_id = (
                block_cache[
                    block_name
                ]
            )


        else:

            # ------------------------------------------------
            # BLOCK ALREADY EXISTS IN DRAWING
            # → RELOAD FROM EXTERNAL DWG
            # ------------------------------------------------

            if block_table.Has(
                block_name
            ):

                block_id = (
                    block_table.get_Item(
                        block_name
                    )
                )


                reload_ok, reload_message = (
                    reload_existing_block(
                        db,
                        transaction,
                        block_id,
                        path
                    )
                )


                if reload_ok:

                    reloaded_blocks.append(
                        block_name
                    )


                else:

                    errors.append({

                        "Index":
                            index,

                        "ID":
                            segment_id,

                        "BlockName":
                            block_name,

                        "Reason":
                            "Block reload failed",

                        "Detail":
                            reload_message
                    })

                    continue


            # ------------------------------------------------
            # BLOCK DOES NOT EXIST
            # → LOAD IT FOR FIRST TIME
            # ------------------------------------------------

            else:

                source_db = Database(
                    False,
                    True
                )

                try:

                    source_db.ReadDwgFile(
                        path,
                        FileOpenMode.OpenForReadAndAllShare,
                        True,
                        ""
                    )

                    source_db.CloseInput(
                        True
                    )


                    block_id = db.Insert(
                        block_name,
                        source_db,
                        False
                    )


                    loaded_blocks.append(
                        block_name
                    )


                finally:

                    try:
                        source_db.Dispose()
                    except:
                        pass


            # ------------------------------------------------
            # SAVE IN CACHE
            # ------------------------------------------------

            block_cache[
                block_name
            ] = block_id


        # ====================================================
        # INSERT BLOCKREFERENCE
        # ====================================================

        insertion_point = Point3d(
            xyz[0],
            xyz[1],
            xyz[2]
        )


        block_ref = BlockReference(
            insertion_point,
            block_id
        )


        block_ref.Rotation = (
            rotation
        )


        model_space.AppendEntity(
            block_ref
        )


        transaction.AddNewlyCreatedDBObject(
            block_ref,
            True
        )


        # ====================================================
        # IDENTIFIERS
        # ====================================================

        handle = str(
            block_ref.Handle
        )


        object_id = str(
            block_ref.ObjectId
        )


        handles.append(
            handle
        )


        # ====================================================
        # ENRICHED OBJECT DATA
        # ====================================================

        inserted_data.append({

            "ComponentType":
                "LINEAR",

            "ModuleIndex":
                index,

            "ObjectId":
                object_id,

            "Handle":
                handle,

            "ID":
                segment_id,

            "ParentID":
                parent_id,

            "Station":
                station,

            "Side":
                side,

            "SectionType":
                section_type,

            "BlockName":
                block_name,

            "BlockPath":
                path,

            "Rotation":
                rotation,

            "X":
                xyz[0],

            "Y":
                xyz[1],

            "Z":
                xyz[2]
        })


    # ========================================================
    # COMMIT
    # ========================================================

    transaction.Commit()


except Exception as ex:

    if transaction is not None:

        try:
            transaction.Abort()
        except:
            pass


    errors.append({

        "GeneralError":
            str(ex)
    })


finally:

    if transaction is not None:

        try:
            transaction.Dispose()
        except:
            pass


    if doc_lock is not None:

        try:
            doc_lock.Dispose()
        except:
            pass


# ============================================================
# SUMMARY
# ============================================================

summary = {

    "AvailableItems":
        available_count,

    "RequestedItems":
        process_count,

    "CreatedItems":
        len(inserted_data),

    "ReloadedBlockDefinitions":
        len(reloaded_blocks),

    "LoadedNewBlockDefinitions":
        len(loaded_blocks),

    "ReloadedBlocks":
        reloaded_blocks,

    "LoadedBlocks":
        loaded_blocks,

    "ErrorCount":
        len(errors)
}


# ============================================================
# OUTPUT
# ============================================================

OUT = (
    inserted_data,     # 0
    handles,           # 1
    errors,            # 2
    summary            # 3
)
# ----------------------------------------
code_block_21 = CodeBlock(linins=INSERT_BARRIER_LINEAR) { linins[0]; linins[1]; linins[2]; linins[3]; }

# group: BIM PROPERTYSET ASSIGNMENT
PREPARE_BARRIER_PSET_DATA = Python(IN[0]=code_block_18.out0, IN[1]=code_block_21.out0, IN[2]=code_block_6.out0)  # CPython3
# ---------- PREPARE_BARRIER_PSET_DATA.python (649 lines) ----------
# ============================================================
# PREPARE_BARRIER_PSET_DATA
# CPython3 - Dynamo / Civil 3D
#
# IN[0] = Inserted POST objects metadata
# IN[1] = Inserted LINEAR objects metadata
# IN[2] = Validated BARRIERS data
#
# OUT[0] = POST PropertySet data
# OUT[1] = LINEAR PropertySet data
# OUT[2] = Warnings
# OUT[3] = Summary
# ============================================================


# ============================================================
# INPUTS
# ============================================================

post_inserted_input = IN[0]
linear_inserted_input = IN[1]
barrier_data_input = IN[2]


# ============================================================
# AUXILIARY FUNCTIONS
# ============================================================

def as_list(value):

    if value is None:
        return []

    if isinstance(value, (list, tuple)):

        result = []

        for item in value:

            if isinstance(item, (list, tuple)):
                result.extend(as_list(item))

            else:
                result.append(item)

        return result

    return [value]


def get_value(dictionary, key):

    if dictionary is None:
        return None

    try:

        if isinstance(dictionary, dict):
            return dictionary.get(key)

        if hasattr(dictionary, "ValueAtKey"):
            return dictionary.ValueAtKey(key)

        return dictionary[key]

    except:
        return None


def clean_text(value):

    if value is None:
        return ""

    return str(value).strip()


def to_number(value, default=0.0):

    if value is None:
        return default

    if isinstance(value, (int, float)):
        return float(value)

    try:

        text = str(value).strip().replace(",", ".")
        return float(text)

    except:
        return default


# ============================================================
# PREPARE INPUT LISTS
# ============================================================

post_inserted = as_list(
    post_inserted_input
)

linear_inserted = as_list(
    linear_inserted_input
)

barrier_data = as_list(
    barrier_data_input
)


# ============================================================
# BUILD LOOKUP BY BARRIER ID
#
# Example:
# B001 → original BARRIERS record
# ============================================================

barrier_lookup = {}


for item in barrier_data:

    barrier_id = clean_text(
        get_value(
            item,
            "ID"
        )
    )

    if barrier_id == "":
        continue

    barrier_lookup[
        barrier_id
    ] = item


# ============================================================
# OUTPUT COLLECTIONS
# ============================================================

post_pset_data = []
linear_pset_data = []

warnings = []


# ============================================================
# CREATE PROPERTY SET RECORD
# ============================================================

def build_pset_record(
    inserted,
    component_type
):

    parent_id = clean_text(
        get_value(
            inserted,
            "ParentID"
        )
    )

    segment_id = clean_text(
        get_value(
            inserted,
            "ID"
        )
    )


    # --------------------------------------------------------
    # FIND ORIGINAL BARRIER RECORD
    # --------------------------------------------------------

    source = barrier_lookup.get(
        parent_id
    )


    if source is None:

        warnings.append(
            "{} object | ParentID '{}': "
            "original BARRIERS record not found."
            .format(
                component_type,
                parent_id
            )
        )

        return None


    # --------------------------------------------------------
    # INSERTED OBJECT INFORMATION
    # --------------------------------------------------------

    handle = clean_text(
        get_value(
            inserted,
            "Handle"
        )
    )

    object_id = clean_text(
        get_value(
            inserted,
            "ObjectId"
        )
    )

    station = to_number(
        get_value(
            inserted,
            "Station"
        )
    )

    side = clean_text(
        get_value(
            inserted,
            "Side"
        )
    )

    block_name = clean_text(
        get_value(
            inserted,
            "BlockName"
        )
    )

    x = to_number(
        get_value(
            inserted,
            "X"
        )
    )

    y = to_number(
        get_value(
            inserted,
            "Y"
        )
    )

    z = to_number(
        get_value(
            inserted,
            "Z"
        )
    )


    # --------------------------------------------------------
    # ORIGINAL BARRIER DATA
    # --------------------------------------------------------

    barrier_family = clean_text(
        get_value(
            source,
            "BarrierFamily"
        )
    )

    barrier_type = clean_text(
        get_value(
            source,
            "BarrierType"
        )
    )

    material = clean_text(
        get_value(
            source,
            "Material"
        )
    )

    layer = clean_text(
        get_value(
            source,
            "Layer"
        )
    )

    containment_level = clean_text(
        get_value(
            source,
            "ContainmentLevel"
        )
    )

    working_width = clean_text(
        get_value(
            source,
            "WorkingWidth"
        )
    )

    notes = clean_text(
        get_value(
            source,
            "Notes"
        )
    )

    pk_start_value = to_number(
        get_value(
            source,
            "PKStartValue"
        )
    )

    pk_end_value = to_number(
        get_value(
            source,
            "PKEndValue"
        )
    )

    pk_start_label = clean_text(
        get_value(
            source,
            "PKStartLabel"
        )
    )

    pk_end_label = clean_text(
        get_value(
            source,
            "PKEndLabel"
        )
    )

    offset = to_number(
        get_value(
            source,
            "DefaultOffset"
        )
    )

    height = to_number(
        get_value(
            source,
            "Height"
        )
    )

    width = to_number(
        get_value(
            source,
            "Width"
        )
    )

    post_spacing = to_number(
        get_value(
            source,
            "PostSpacing"
        )
    )

    module_length = to_number(
        get_value(
            source,
            "ModuleLength"
        )
    )

    time_unit_length = to_number(
        get_value(
            source,
            "TimeUnitLength(h)"
        )
    )

    cost_unit_length = to_number(
        get_value(
            source,
            "CostUnitLength"
        )
    )

    ifc_entity = clean_text(
        get_value(
            source,
            "IFCEntity"
        )
    )

    type_code = clean_text(
        get_value(
            source,
            "Type"
        )
    )


    # --------------------------------------------------------
    # DERIVED VALUES
    # --------------------------------------------------------

    segment_length = max(
        0.0,
        pk_end_value - pk_start_value
    )


    cost_segment = (
        cost_unit_length
        * segment_length
    )


    time_segment = (
        time_unit_length
        * segment_length
    )


    # --------------------------------------------------------
    # COMMON PROPERTY SET DATA
    # --------------------------------------------------------

    record = {

        # --------------------------------------------
        # OBJECT IDENTIFICATION
        # --------------------------------------------

        "Handle":
            handle,

        "ObjectId":
            object_id,

        "ComponentType":
            component_type,

        "ParentID":
            parent_id,

        "ID":
            segment_id,

        "Type":
            type_code,

        "Side":
            side,

        "Block":
            block_name,

        "IFCEntity":
            ifc_entity,


        # --------------------------------------------
        # BARRIER INFORMATION
        # --------------------------------------------

        "BarrierFamily":
            barrier_family,

        "BarrierType":
            barrier_type,

        "Material":
            material,

        "Layer":
            layer,

        "ContainmentLevel":
            containment_level,

        "WorkingWidth":
            working_width,

        "Notes":
            notes,


        # --------------------------------------------
        # ALIGNMENT / STATION INFORMATION
        # --------------------------------------------

        "Station":
            station,

        "PKStartValue":
            pk_start_value,

        "PKEndValue":
            pk_end_value,

        "PKStartLabel":
            pk_start_label,

        "PKEndLabel":
            pk_end_label,

        "Offset":
            offset,


        # --------------------------------------------
        # COORDINATES
        # --------------------------------------------

        "CoordinateX":
            x,

        "CoordinateY":
            y,

        "CoordinateZ":
            z,

        "Elevation":
            z,


        # --------------------------------------------
        # GEOMETRY
        # --------------------------------------------

        "Height":
            height,

        "Width":
            width,

        "PostSpacing":
            post_spacing,

        "ModuleLength":
            module_length,


        # --------------------------------------------
        # 4D / 5D
        # --------------------------------------------

        "TimeUnitLength(h)":
            time_unit_length,

        "CostUnitLength":
            cost_unit_length,

        "TimeSegment(h)":
            time_segment,

        "CostSegment":
            cost_segment,


        # --------------------------------------------
        # GUID
        #
        # Left empty for now.
        # We can populate it later when IFC/ObjectGUID
        # generation is implemented.
        # --------------------------------------------

        "ObjectGUID":
            ""
    }


    return record


# ============================================================
# POSTS
# ============================================================

for item in post_inserted:

    record = build_pset_record(
        item,
        "POST"
    )

    if record is not None:

        post_pset_data.append(
            record
        )


# ============================================================
# LINEAR MODULES
# ============================================================

for item in linear_inserted:

    record = build_pset_record(
        item,
        "LINEAR"
    )

    if record is not None:

        linear_pset_data.append(
            record
        )


# ============================================================
# SUMMARY
# ============================================================

summary = {

    "PostInsertedInput":
        len(post_inserted),

    "PostPsetRecords":
        len(post_pset_data),

    "LinearInsertedInput":
        len(linear_inserted),

    "LinearPsetRecords":
        len(linear_pset_data),

    "BarrierRecords":
        len(barrier_data),

    "WarningCount":
        len(warnings)
}


# ============================================================
# OUTPUT
# ============================================================

OUT = (
    post_pset_data,       # 0
    linear_pset_data,     # 1
    warnings,             # 2
    summary               # 3
)
# ----------------------------------------
code_block_22 = CodeBlock(pset=PREPARE_BARRIER_PSET_DATA) { pset[0]; pset[1]; pset[2]; pset[3]; }
code_block_23 = CodeBlock { "PSET_BARRIERS_POST"; "PSET_BARRIERS_LINEAR"; }
ASSIGN_BARRIER_PROPERTYSET = Python(IN[0]=code_block_22.out0, IN[1]=code_block_23.out0)  # CPython3
# ---------- ASSIGN_BARRIER_PROPERTYSET.python (803 lines) ----------
# ============================================================
# ASSIGN_BARRIER_PROPERTYSET_V4
# CPython3 - Civil 3D / AEC Property Data
#
# IN[0] = Prepared PsetData
# IN[1] = Property Set Definition Name
#
# OUT[0] = Assigned objects
# OUT[1] = Errors
# OUT[2] = Summary
# ============================================================

import clr

# ============================================================
# REFERENCES
# ============================================================

clr.AddReference("AcMgd")
clr.AddReference("AcDbMgd")
clr.AddReference("AcCoreMgd")

clr.AddReference("AecBaseMgd")
clr.AddReference("AecPropDataMgd")


from Autodesk.AutoCAD.ApplicationServices import Application

from Autodesk.AutoCAD.DatabaseServices import (
    OpenMode,
    Handle
)

from Autodesk.Aec.PropertyData.DatabaseServices import (
    PropertyDataServices,
    DictionaryPropertySetDefinitions
)


# ============================================================
# INPUTS
# ============================================================

data_input = IN[0]
pset_name_input = IN[1]


# ============================================================
# BASIC HELPERS
# ============================================================

def as_list(value):

    if value is None:
        return []

    if isinstance(value, (list, tuple)):
        return list(value)

    return [value]


def clean_text(value):

    if value is None:
        return ""

    return str(value).strip()


def get_value(dictionary, key):

    if dictionary is None:
        return None

    try:

        if isinstance(dictionary, dict):
            return dictionary.get(key)

        if hasattr(dictionary, "ValueAtKey"):
            return dictionary.ValueAtKey(key)

        return dictionary[key]

    except:
        return None


# ============================================================
# HANDLE → OBJECT ID
# ============================================================

def get_object_id_from_handle(
    database,
    handle_text
):

    try:

        handle_number = int(
            str(handle_text),
            16
        )

        acad_handle = Handle(
            handle_number
        )

        return database.GetObjectId(
            False,
            acad_handle,
            0
        )

    except:
        return None


# ============================================================
# GET PROPERTY SET DEFINITION
#
# IMPORTANT:
# We do NOT use .Has().
# We ask directly for GetAt(name).
# ============================================================

def get_pset_definition_id(
    database,
    definition_name
):

    try:

        definitions = (
            DictionaryPropertySetDefinitions(
                database
            )
        )

        definition_id = definitions.GetAt(
            definition_name
        )

        return definition_id

    except:
        return None


# ============================================================
# FIND ATTACHED PROPERTY SET
# ============================================================

def find_attached_pset(
    db_object,
    definition_id,
    transaction
):

    try:

        pset_ids = (
            PropertyDataServices
            .GetPropertySets(
                db_object
            )
        )

        for pset_id in pset_ids:

            try:

                pset = transaction.GetObject(
                    pset_id,
                    OpenMode.ForRead
                )

                if (
                    pset.PropertySetDefinition
                    == definition_id
                ):

                    return pset_id

            except:
                pass

    except:
        pass

    return None


# ============================================================
# SET PROPERTY
# ============================================================

def set_property(
    pset,
    property_name,
    value
):

    if value is None:
        return False


    # --------------------------------------------------------
    # PROPERTY NAME → PROPERTY ID
    # --------------------------------------------------------

    try:

        property_id = (
            pset.PropertyNameToId(
                property_name
            )
        )

    except:
        return False


    try:

        if property_id < 0:
            return False

    except:
        pass


    # --------------------------------------------------------
    # DATA TYPE
    # --------------------------------------------------------

    if isinstance(value, bool):

        final_value = value

    elif isinstance(
        value,
        (int, float)
    ):

        final_value = float(value)

    else:

        final_value = str(value)


    # --------------------------------------------------------
    # WRITE
    # --------------------------------------------------------

    try:

        pset.SetAt(
            property_id,
            final_value
        )

        return True

    except:

        # Some AEC properties are picky about datatype.
        try:

            pset.SetAt(
                property_id,
                str(final_value)
            )

            return True

        except:

            return False


# ============================================================
# PREPARE
# ============================================================

records = as_list(
    data_input
)

pset_name = clean_text(
    pset_name_input
)

assigned = []
errors = []


# ============================================================
# DOCUMENT
# ============================================================

doc = (
    Application
    .DocumentManager
    .MdiActiveDocument
)

db = doc.Database

doc_lock = None
transaction = None


# ============================================================
# MAIN
# ============================================================

try:

    # --------------------------------------------------------
    # LOCK DOCUMENT
    # --------------------------------------------------------

    doc_lock = doc.LockDocument()


    # --------------------------------------------------------
    # TRANSACTION
    # --------------------------------------------------------

    transaction = (
        db.TransactionManager
        .StartTransaction()
    )


    # ========================================================
    # FIND PSET DEFINITION
    # ========================================================

    definition_id = (
        get_pset_definition_id(
            db,
            pset_name
        )
    )


    if definition_id is None:

        raise Exception(
            "Property Set Definition '{}' could not be resolved."
            .format(
                pset_name
            )
        )


    # ========================================================
    # PROCESS OBJECTS
    # ========================================================

    for index, record in enumerate(records):


        # ----------------------------------------------------
        # HANDLE
        # ----------------------------------------------------

        handle_text = clean_text(
            get_value(
                record,
                "Handle"
            )
        )


        if handle_text == "":

            errors.append({

                "Index":
                    index,

                "Reason":
                    "Handle is empty"
            })

            continue


        # ----------------------------------------------------
        # HANDLE → OBJECT ID
        # ----------------------------------------------------

        object_id = (
            get_object_id_from_handle(
                db,
                handle_text
            )
        )


        if object_id is None:

            errors.append({

                "Index":
                    index,

                "Handle":
                    handle_text,

                "Reason":
                    "Could not resolve ObjectId from Handle"
            })

            continue


        # ----------------------------------------------------
        # OPEN BLOCKREFERENCE / AUTOCAD OBJECT
        # ----------------------------------------------------

        try:

            db_object = transaction.GetObject(
                object_id,
                OpenMode.ForWrite
            )

        except Exception as ex:

            errors.append({

                "Index":
                    index,

                "Handle":
                    handle_text,

                "Reason":
                    "Could not open AutoCAD object",

                "Detail":
                    str(ex)
            })

            continue


        # ====================================================
        # CHECK IF PSET ALREADY EXISTS
        # ====================================================

        pset_id = (
            find_attached_pset(
                db_object,
                definition_id,
                transaction
            )
        )


        # ====================================================
        # ATTACH PSET IF NECESSARY
        # ====================================================

        if pset_id is None:

            try:

                PropertyDataServices.AddPropertySet(
                    db_object,
                    definition_id
                )

            except Exception as ex:

                errors.append({

                    "Index":
                        index,

                    "Handle":
                        handle_text,

                    "Reason":
                        "Could not attach Property Set",

                    "Detail":
                        str(ex)
                })

                continue


            # ------------------------------------------------
            # FIND NEWLY ATTACHED PSET
            # ------------------------------------------------

            pset_id = (
                find_attached_pset(
                    db_object,
                    definition_id,
                    transaction
                )
            )


        if pset_id is None:

            errors.append({

                "Index":
                    index,

                "Handle":
                    handle_text,

                "Reason":
                    "Pset was not found after AddPropertySet"
            })

            continue


        # ====================================================
        # OPEN PSET FOR WRITE
        # ====================================================

        pset = transaction.GetObject(
            pset_id,
            OpenMode.ForWrite
        )


        # ====================================================
        # COMMON PROPERTIES
        # ====================================================

        properties_to_write = {

            "ParentID":
                get_value(record, "ParentID"),

            "ID":
                get_value(record, "ID"),
               
            "Type":
                get_value(record, "Type"),

            "BarrierFamily":
                get_value(record, "BarrierFamily"),
            
            "IfcEntity":
                get_value(record, "IFCEntity"),

            "BarrierType":
                get_value(record, "BarrierType"),

            "Block":
                get_value(record, "Block"),

            "Side":
                get_value(record, "Side"),

            "PKStartValue":
                get_value(record, "PKStartValue"),

            "PKEndValue":
                get_value(record, "PKEndValue"),

            "PKStartLabel":
                get_value(record, "PKStartLabel"),

            "PKEndLabel":
                get_value(record, "PKEndLabel"),

            "Offset":
                get_value(record, "Offset"),

            "CoordinateX":
                get_value(record, "CoordinateX"),

            "CoordinateY":
                get_value(record, "CoordinateY"),

            "CoordinateZ":
                get_value(record, "CoordinateZ"),

            "Elevation":
                get_value(record, "Elevation"),

            "Height":
                get_value(record, "Height"),

            "Width":
                get_value(record, "Width"),

            "Material":
                get_value(record, "Material"),

            "Layer":
                get_value(record, "Layer"),

            "ContainmentLevel":
                get_value(record, "ContainmentLevel"),

            "WorkingWidth":
                get_value(record, "WorkingWidth"),

            "TimeUnitLength(h)":
                get_value(record, "TimeUnitLength(h)"),

            "CostUnitLength":
                get_value(record, "CostUnitLength"),

            "TimeSegment(h)":
                get_value(record, "TimeSegment(h)"),

            "CostSegment":
                get_value(record, "CostSegment"),

            "Notes":
                get_value(record, "Notes"),

            "ObjectGUID":
                get_value(record, "ObjectGUID")
        }


        # ====================================================
        # COMPONENT-SPECIFIC PROPERTIES
        # ====================================================

        component_type = clean_text(
            get_value(
                record,
                "ComponentType"
            )
        ).upper()


        if component_type == "POST":

            properties_to_write[
                "PostSpacing"
            ] = get_value(
                record,
                "PostSpacing"
            )


        elif component_type == "LINEAR":

            properties_to_write[
                "ModuleLength"
            ] = get_value(
                record,
                "ModuleLength"
            )


        # ====================================================
        # WRITE PROPERTY VALUES
        # ====================================================

        written_count = 0
        skipped_properties = []


        for (
            property_name,
            property_value
        ) in properties_to_write.items():

            if set_property(
                pset,
                property_name,
                property_value
            ):

                written_count += 1

            else:

                skipped_properties.append(
                    property_name
                )


        # ====================================================
        # SUCCESS
        # ====================================================

        assigned.append({

            "Index":
                index,

            "Handle":
                handle_text,

            "Pset":
                pset_name,

            "ParentID":
                get_value(
                    record,
                    "ParentID"
                ),

            "ID":
                get_value(
                    record,
                    "ID"
                ),

            "ComponentType":
                component_type,

            "PropertiesWritten":
                written_count,

            "PropertiesSkipped":
                skipped_properties
        })


    # ========================================================
    # COMMIT
    # ========================================================

    transaction.Commit()


except Exception as ex:

    if transaction is not None:

        try:
            transaction.Abort()
        except:
            pass


    errors.append({

        "GeneralError":
            str(ex)
    })


finally:

    if transaction is not None:

        try:
            transaction.Dispose()
        except:
            pass


    if doc_lock is not None:

        try:
            doc_lock.Dispose()
        except:
            pass


# ============================================================
# SUMMARY
# ============================================================

summary = {

    "PsetName":
        pset_name,

    "InputRecords":
        len(records),

    "AssignedObjects":
        len(assigned),

    "ErrorCount":
        len(errors)
}


# ============================================================
# OUTPUT
# ============================================================

OUT = (
    assigned,      # 0
    errors,        # 1
    summary        # 2
)
# ----------------------------------------
code_block_24 = CodeBlock(assign=ASSIGN_BARRIER_PROPERTYSET) { assign[0]; assign[1]; assign[2]; }
ASSIGN_BARRIER_PROPERTYSET_2 = Python(IN[0]=code_block_22.out1, IN[1]=code_block_23.out1)  # CPython3
# ---------- ASSIGN_BARRIER_PROPERTYSET_2.python (803 lines) ----------
# ============================================================
# ASSIGN_BARRIER_PROPERTYSET_V4
# CPython3 - Civil 3D / AEC Property Data
#
# IN[0] = Prepared PsetData
# IN[1] = Property Set Definition Name
#
# OUT[0] = Assigned objects
# OUT[1] = Errors
# OUT[2] = Summary
# ============================================================

import clr

# ============================================================
# REFERENCES
# ============================================================

clr.AddReference("AcMgd")
clr.AddReference("AcDbMgd")
clr.AddReference("AcCoreMgd")

clr.AddReference("AecBaseMgd")
clr.AddReference("AecPropDataMgd")


from Autodesk.AutoCAD.ApplicationServices import Application

from Autodesk.AutoCAD.DatabaseServices import (
    OpenMode,
    Handle
)

from Autodesk.Aec.PropertyData.DatabaseServices import (
    PropertyDataServices,
    DictionaryPropertySetDefinitions
)


# ============================================================
# INPUTS
# ============================================================

data_input = IN[0]
pset_name_input = IN[1]


# ============================================================
# BASIC HELPERS
# ============================================================

def as_list(value):

    if value is None:
        return []

    if isinstance(value, (list, tuple)):
        return list(value)

    return [value]


def clean_text(value):

    if value is None:
        return ""

    return str(value).strip()


def get_value(dictionary, key):

    if dictionary is None:
        return None

    try:

        if isinstance(dictionary, dict):
            return dictionary.get(key)

        if hasattr(dictionary, "ValueAtKey"):
            return dictionary.ValueAtKey(key)

        return dictionary[key]

    except:
        return None


# ============================================================
# HANDLE → OBJECT ID
# ============================================================

def get_object_id_from_handle(
    database,
    handle_text
):

    try:

        handle_number = int(
            str(handle_text),
            16
        )

        acad_handle = Handle(
            handle_number
        )

        return database.GetObjectId(
            False,
            acad_handle,
            0
        )

    except:
        return None


# ============================================================
# GET PROPERTY SET DEFINITION
#
# IMPORTANT:
# We do NOT use .Has().
# We ask directly for GetAt(name).
# ============================================================

def get_pset_definition_id(
    database,
    definition_name
):

    try:

        definitions = (
            DictionaryPropertySetDefinitions(
                database
            )
        )

        definition_id = definitions.GetAt(
            definition_name
        )

        return definition_id

    except:
        return None


# ============================================================
# FIND ATTACHED PROPERTY SET
# ============================================================

def find_attached_pset(
    db_object,
    definition_id,
    transaction
):

    try:

        pset_ids = (
            PropertyDataServices
            .GetPropertySets(
                db_object
            )
        )

        for pset_id in pset_ids:

            try:

                pset = transaction.GetObject(
                    pset_id,
                    OpenMode.ForRead
                )

                if (
                    pset.PropertySetDefinition
                    == definition_id
                ):

                    return pset_id

            except:
                pass

    except:
        pass

    return None


# ============================================================
# SET PROPERTY
# ============================================================

def set_property(
    pset,
    property_name,
    value
):

    if value is None:
        return False


    # --------------------------------------------------------
    # PROPERTY NAME → PROPERTY ID
    # --------------------------------------------------------

    try:

        property_id = (
            pset.PropertyNameToId(
                property_name
            )
        )

    except:
        return False


    try:

        if property_id < 0:
            return False

    except:
        pass


    # --------------------------------------------------------
    # DATA TYPE
    # --------------------------------------------------------

    if isinstance(value, bool):

        final_value = value

    elif isinstance(
        value,
        (int, float)
    ):

        final_value = float(value)

    else:

        final_value = str(value)


    # --------------------------------------------------------
    # WRITE
    # --------------------------------------------------------

    try:

        pset.SetAt(
            property_id,
            final_value
        )

        return True

    except:

        # Some AEC properties are picky about datatype.
        try:

            pset.SetAt(
                property_id,
                str(final_value)
            )

            return True

        except:

            return False


# ============================================================
# PREPARE
# ============================================================

records = as_list(
    data_input
)

pset_name = clean_text(
    pset_name_input
)

assigned = []
errors = []


# ============================================================
# DOCUMENT
# ============================================================

doc = (
    Application
    .DocumentManager
    .MdiActiveDocument
)

db = doc.Database

doc_lock = None
transaction = None


# ============================================================
# MAIN
# ============================================================

try:

    # --------------------------------------------------------
    # LOCK DOCUMENT
    # --------------------------------------------------------

    doc_lock = doc.LockDocument()


    # --------------------------------------------------------
    # TRANSACTION
    # --------------------------------------------------------

    transaction = (
        db.TransactionManager
        .StartTransaction()
    )


    # ========================================================
    # FIND PSET DEFINITION
    # ========================================================

    definition_id = (
        get_pset_definition_id(
            db,
            pset_name
        )
    )


    if definition_id is None:

        raise Exception(
            "Property Set Definition '{}' could not be resolved."
            .format(
                pset_name
            )
        )


    # ========================================================
    # PROCESS OBJECTS
    # ========================================================

    for index, record in enumerate(records):


        # ----------------------------------------------------
        # HANDLE
        # ----------------------------------------------------

        handle_text = clean_text(
            get_value(
                record,
                "Handle"
            )
        )


        if handle_text == "":

            errors.append({

                "Index":
                    index,

                "Reason":
                    "Handle is empty"
            })

            continue


        # ----------------------------------------------------
        # HANDLE → OBJECT ID
        # ----------------------------------------------------

        object_id = (
            get_object_id_from_handle(
                db,
                handle_text
            )
        )


        if object_id is None:

            errors.append({

                "Index":
                    index,

                "Handle":
                    handle_text,

                "Reason":
                    "Could not resolve ObjectId from Handle"
            })

            continue


        # ----------------------------------------------------
        # OPEN BLOCKREFERENCE / AUTOCAD OBJECT
        # ----------------------------------------------------

        try:

            db_object = transaction.GetObject(
                object_id,
                OpenMode.ForWrite
            )

        except Exception as ex:

            errors.append({

                "Index":
                    index,

                "Handle":
                    handle_text,

                "Reason":
                    "Could not open AutoCAD object",

                "Detail":
                    str(ex)
            })

            continue


        # ====================================================
        # CHECK IF PSET ALREADY EXISTS
        # ====================================================

        pset_id = (
            find_attached_pset(
                db_object,
                definition_id,
                transaction
            )
        )


        # ====================================================
        # ATTACH PSET IF NECESSARY
        # ====================================================

        if pset_id is None:

            try:

                PropertyDataServices.AddPropertySet(
                    db_object,
                    definition_id
                )

            except Exception as ex:

                errors.append({

                    "Index":
                        index,

                    "Handle":
                        handle_text,

                    "Reason":
                        "Could not attach Property Set",

                    "Detail":
                        str(ex)
                })

                continue


            # ------------------------------------------------
            # FIND NEWLY ATTACHED PSET
            # ------------------------------------------------

            pset_id = (
                find_attached_pset(
                    db_object,
                    definition_id,
                    transaction
                )
            )


        if pset_id is None:

            errors.append({

                "Index":
                    index,

                "Handle":
                    handle_text,

                "Reason":
                    "Pset was not found after AddPropertySet"
            })

            continue


        # ====================================================
        # OPEN PSET FOR WRITE
        # ====================================================

        pset = transaction.GetObject(
            pset_id,
            OpenMode.ForWrite
        )


        # ====================================================
        # COMMON PROPERTIES
        # ====================================================

        properties_to_write = {

            "ParentID":
                get_value(record, "ParentID"),

            "ID":
                get_value(record, "ID"),
                
            "Type":
                get_value(record, "Type"),

            "BarrierFamily":
                get_value(record, "BarrierFamily"),
               
             "IfcEntity":
                get_value(record, "IFCEntity"),

            "BarrierType":
                get_value(record, "BarrierType"),

            "Block":
                get_value(record, "Block"),

            "Side":
                get_value(record, "Side"),

            "PKStartValue":
                get_value(record, "PKStartValue"),

            "PKEndValue":
                get_value(record, "PKEndValue"),

            "PKStartLabel":
                get_value(record, "PKStartLabel"),

            "PKEndLabel":
                get_value(record, "PKEndLabel"),

            "Offset":
                get_value(record, "Offset"),

            "CoordinateX":
                get_value(record, "CoordinateX"),

            "CoordinateY":
                get_value(record, "CoordinateY"),

            "CoordinateZ":
                get_value(record, "CoordinateZ"),

            "Elevation":
                get_value(record, "Elevation"),

            "Height":
                get_value(record, "Height"),

            "Width":
                get_value(record, "Width"),

            "Material":
                get_value(record, "Material"),

            "Layer":
                get_value(record, "Layer"),

            "ContainmentLevel":
                get_value(record, "ContainmentLevel"),

            "WorkingWidth":
                get_value(record, "WorkingWidth"),

            "TimeUnitLength(h)":
                get_value(record, "TimeUnitLength(h)"),

            "CostUnitLength":
                get_value(record, "CostUnitLength"),

            "TimeSegment(h)":
                get_value(record, "TimeSegment(h)"),

            "CostSegment":
                get_value(record, "CostSegment"),

            "Notes":
                get_value(record, "Notes"),

            "ObjectGUID":
                get_value(record, "ObjectGUID")
        }


        # ====================================================
        # COMPONENT-SPECIFIC PROPERTIES
        # ====================================================

        component_type = clean_text(
            get_value(
                record,
                "ComponentType"
            )
        ).upper()


        if component_type == "POST":

            properties_to_write[
                "PostSpacing"
            ] = get_value(
                record,
                "PostSpacing"
            )


        elif component_type == "LINEAR":

            properties_to_write[
                "ModuleLength"
            ] = get_value(
                record,
                "ModuleLength"
            )


        # ====================================================
        # WRITE PROPERTY VALUES
        # ====================================================

        written_count = 0
        skipped_properties = []


        for (
            property_name,
            property_value
        ) in properties_to_write.items():

            if set_property(
                pset,
                property_name,
                property_value
            ):

                written_count += 1

            else:

                skipped_properties.append(
                    property_name
                )


        # ====================================================
        # SUCCESS
        # ====================================================

        assigned.append({

            "Index":
                index,

            "Handle":
                handle_text,

            "Pset":
                pset_name,

            "ParentID":
                get_value(
                    record,
                    "ParentID"
                ),

            "ID":
                get_value(
                    record,
                    "ID"
                ),

            "ComponentType":
                component_type,

            "PropertiesWritten":
                written_count,

            "PropertiesSkipped":
                skipped_properties
        })


    # ========================================================
    # COMMIT
    # ========================================================

    transaction.Commit()


except Exception as ex:

    if transaction is not None:

        try:
            transaction.Abort()
        except:
            pass


    errors.append({

        "GeneralError":
            str(ex)
    })


finally:

    if transaction is not None:

        try:
            transaction.Dispose()
        except:
            pass


    if doc_lock is not None:

        try:
            doc_lock.Dispose()
        except:
            pass


# ============================================================
# SUMMARY
# ============================================================

summary = {

    "PsetName":
        pset_name,

    "InputRecords":
        len(records),

    "AssignedObjects":
        len(assigned),

    "ErrorCount":
        len(errors)
}


# ============================================================
# OUTPUT
# ============================================================

OUT = (
    assigned,      # 0
    errors,        # 1
    summary        # 2
)
# ----------------------------------------
code_block_25 = CodeBlock(assign=ASSIGN_BARRIER_PROPERTYSET_2) { assign[0]; assign[1]; assign[2]; }
