# Dynamo graph TrafficSignCorridorTool_PKReal_v1.4.dyn (Dynamo 3.6.1.9956)
# author: Carlos Peña
# Automatically places BIM traffic signs along a Civil 3D corridor from an Excel template, assigning IFC property sets, geometry, scheduling and cost attributes.
# packages: Civil3DToolkit 1.1.32

# group: INPUT_DATA
offset_desde_código = DoubleInput(0.8)
directoryBlock = Directory("C:\Users\CARLOS\Desktop\BIM_SIGNS\SIGN_LIBRARY")  # graph input
archivo_excel = Filename(".\TrafficSign_BIM_Template_PKReal_v4.xlsx")  # graph input
corridors = CorridorNameDropDown("T1-6+300_7+300")  # graph input
código_punto = StringInput("ETW")  # graph input
código_punto_2 = StringInput("EPS")  # graph input

list_create = List.Create(item0=código_punto, item1=código_punto_2)

# group: FEATURE LINES AND SIDE (L or R)
baselines = Autodesk.Civil.DynamoNodes.Corridor.Baselines(corridor=corridors)
corridorFeatureLinesByCode = Autodesk.Civil.DynamoNodes.Baseline.CorridorFeatureLinesByCode(baseline=baselines, pointCode=list_create@L2, lacing=Shortest)
code_block = CodeBlock { -1; }
flatten = List.Flatten(list=corridorFeatureLinesByCode, amount=code_block)
side = Autodesk.Civil.DynamoNodes.CorridorFeatureLine.Side(corridorFeatureLine=flatten)
code_block_2 = CodeBlock { 0; }
gt = side > code_block_2
filterByBoolMask = List.FilterByBoolMask(list=flatten, mask=gt)

# group: EXCEL DATA SHEET IMPORT
excelSheet = StringInput("SIGNS")  # graph input
code_block_3 = CodeBlock { 1; }
code_block_4 = CodeBlock { 0; }
code_block_5 = CodeBlock { false; }
openXMLImportExcel = Data.OpenXMLImportExcel(filePath=archivo_excel, sheetName=excelSheet, startRow=code_block_3, startColumn=code_block_4, readAsString=code_block_5)
blockDirectory = Python(IN[0]=directoryBlock, IN[1]=openXMLImportExcel)  # CPython3
# ---------- blockDirectory.python (388 lines) ----------
# CPython3 - Dynamo / Civil 3D
# Loads external DWG files as block definitions in the active drawing.
#
# IN[0] = User-selected DWG library folder
# IN[1] = Complete Excel table imported from the SIGNS worksheet
#
# OUT[0] = Block definitions loaded from DWG files
# OUT[1] = Block definitions already existing in the active drawing
# OUT[2] = Missing DWG files
# OUT[3] = Errors and warnings
# OUT[4] = Excel table passed to the next node
# OUT[5] = General status: True when all required blocks are available

import clr
import os

clr.AddReference("AcMgd")
clr.AddReference("AcDbMgd")

from Autodesk.AutoCAD.ApplicationServices import Application
from Autodesk.AutoCAD.DatabaseServices import (
    Database,
    OpenMode,
    FileOpenMode
)


# ============================================================
# AUXILIARY FUNCTIONS
# ============================================================

def clean_text(value):
    """Converts Dynamo, Excel, or Directory Path values to clean text."""
    if value is None:
        return ""

    # Directory Path nodes may return a DirectoryInfo object
    if hasattr(value, "FullName"):
        return str(value.FullName).strip()

    return str(value).strip()


def ensure_rows(value):
    """Ensures that the Excel input is represented as a list of rows."""
    if value is None:
        return []

    if isinstance(value, (list, tuple)):
        return list(value)

    return [value]


def block_exists(database, block_name):
    """Checks whether a block definition already exists in the active DWG."""
    transaction = database.TransactionManager.StartTransaction()

    try:
        block_table = transaction.GetObject(
            database.BlockTableId,
            OpenMode.ForRead
        )

        exists = block_table.Has(block_name)
        transaction.Commit()

        return exists

    except Exception:
        transaction.Abort()
        raise

    finally:
        transaction.Dispose()


def find_header_index(header, possible_names):
    """
    Finds a column index from a list of possible header names.
    Spaces and uppercase/lowercase differences are ignored.
    """
    normalized_headers = {}

    for index, value in enumerate(header):
        key = clean_text(value).replace(" ", "").lower()
        normalized_headers[key] = index

    for name in possible_names:
        key = clean_text(name).replace(" ", "").lower()

        if key in normalized_headers:
            return normalized_headers[key]

    return None


# ============================================================
# INPUTS
# ============================================================

library_folder = clean_text(IN[0])
excel_data = ensure_rows(IN[1])


# ============================================================
# OUTPUT COLLECTIONS
# ============================================================

loaded_blocks = []
existing_blocks = []
missing_files = []
errors = []

# Prevents repeated processing of the same block type
checked_blocks = set()


# ============================================================
# INITIAL VALIDATION
# ============================================================

if library_folder == "":
    errors.append("No DWG library folder was selected.")

elif not os.path.isdir(library_folder):
    errors.append(
        "The selected DWG library folder does not exist: {}"
        .format(library_folder)
    )

elif len(excel_data) == 0:
    errors.append("The imported Excel table is empty.")


# ============================================================
# COLUMN IDENTIFICATION
# ============================================================

# Default positions in the current SIGNS worksheet:
# Column B = BlockName = index 1
# Column M = DWGName   = index 12

block_index = 1
dwg_index = 12
first_data_row = 0

if len(excel_data) > 0:
    first_row = excel_data[0]

    if isinstance(first_row, (list, tuple)):
        detected_block_index = find_header_index(
            first_row,
            ["BlockName", "Block"]
        )

        detected_dwg_index = find_header_index(
            first_row,
            ["DWGName", "DWGFile"]
        )

        # If headers are included in the imported range, use their positions
        if (
            detected_block_index is not None
            and detected_dwg_index is not None
        ):
            block_index = detected_block_index
            dwg_index = detected_dwg_index
            first_data_row = 1


# ============================================================
# LOAD EXTERNAL DWG FILES AS BLOCK DEFINITIONS
# ============================================================

if len(errors) == 0:

    document = Application.DocumentManager.MdiActiveDocument

    if document is None:
        errors.append("No active Civil 3D document was found.")

    else:
        current_database = document.Database

        try:
            with document.LockDocument():

                data_rows = excel_data[first_data_row:]

                for local_index, row in enumerate(data_rows):
                    excel_row_number = (
                        local_index + first_data_row + 1
                    )

                    try:
                        if row is None:
                            continue

                        if not isinstance(row, (list, tuple)):
                            errors.append(
                                "Row {}: The imported value is not a valid row."
                                .format(excel_row_number)
                            )
                            continue

                        required_length = max(
                            block_index,
                            dwg_index
                        ) + 1

                        if len(row) < required_length:
                            errors.append(
                                "Row {}: Required columns are missing."
                                .format(excel_row_number)
                            )
                            continue

                        block_name = clean_text(row[block_index])
                        dwg_name = clean_text(row[dwg_index])

                        # Ignore completely empty table rows
                        if block_name == "" and dwg_name == "":
                            continue

                        if block_name == "":
                            errors.append(
                                "Row {}: BlockName is empty."
                                .format(excel_row_number)
                            )
                            continue

                        if dwg_name == "":
                            errors.append(
                                "Row {}: DWGName is empty for block '{}'."
                                .format(
                                    excel_row_number,
                                    block_name
                                )
                            )
                            continue

                        block_key = block_name.lower()

                        # Avoid processing repeated signal types
                        if block_key in checked_blocks:
                            continue

                        checked_blocks.add(block_key)

                        # ------------------------------------------------
                        # 1. Check whether the block already exists
                        # ------------------------------------------------

                        if block_exists(
                            current_database,
                            block_name
                        ):
                            existing_blocks.append(block_name)
                            continue

                        # ------------------------------------------------
                        # 2. Build the complete DWG file path
                        # ------------------------------------------------

                        full_path = os.path.normpath(
                            os.path.join(
                                library_folder,
                                dwg_name
                            )
                        )

                        # ------------------------------------------------
                        # 3. Verify that the DWG file exists
                        # ------------------------------------------------

                        if not os.path.isfile(full_path):
                            missing_files.append(
                                "{} -> {}".format(
                                    block_name,
                                    full_path
                                )
                            )
                            continue

                        # ------------------------------------------------
                        # 4. Read the external DWG
                        # ------------------------------------------------

                        source_database = Database(False, True)

                        try:
                            source_database.ReadDwgFile(
                                full_path,
                                FileOpenMode.OpenForReadAndAllShare,
                                True,
                                ""
                            )

                            source_database.CloseInput(True)

                            # --------------------------------------------
                            # 5. Register the external DWG as a block
                            #    definition using BlockName from Excel
                            # --------------------------------------------

                            current_database.Insert(
                                block_name,
                                source_database,
                                False
                            )

                            loaded_blocks.append(block_name)

                        finally:
                            source_database.Dispose()

                    except Exception as row_error:
                        error_text = str(row_error)

                        if "eSelfReference" in error_text:
                            errors.append(
                                "Row {}: '{}' contains a self-referenced "
                                "block definition. Open the DWG file, explode "
                                "all nested block references until only Model "
                                "Space entities remain, run PURGE, save the "
                                "file, and try again."
                                .format(
                                    excel_row_number,
                                    dwg_name
                                )
                            )

                        else:
                            errors.append(
                                "Row {}: {}"
                                .format(
                                    excel_row_number,
                                    error_text
                                )
                            )

            # Regenerate Civil 3D after loading the definitions
            try:
                document.Editor.Regen()
            except Exception:
                pass

        except Exception as general_error:
            errors.append(
                "Unexpected error while loading block definitions: {}"
                .format(str(general_error))
            )


# ============================================================
# FINAL AVAILABILITY CHECK
# ============================================================

# A valid run requires:
# - no missing DWG files;
# - no loading errors.

all_ready = (
    len(missing_files) == 0
    and len(errors) == 0
)

# Only pass the Excel table to the next node when all required
# block definitions are available.
if all_ready:
    data_passthrough = excel_data
else:
    data_passthrough = []


# ============================================================
# OUTPUTS
# ============================================================

OUT = (
    loaded_blocks,      # 0 - Newly loaded block definitions
    existing_blocks,    # 1 - Blocks already present in the active DWG
    missing_files,      # 2 - DWG files not found
    errors,             # 3 - Errors and diagnostic messages
    data_passthrough,   # 4 - Excel data for VALIDATE_PK_WITH_CORRIDOR
    all_ready           # 5 - True when all required blocks are available
)
# ----------------------------------------
code_block_6 = CodeBlock(blockData=blockDirectory) { blockData[4]; blockData[5]; }
VALIDATE_PK_WITH_CORRIDOR = Python(IN[0]=code_block_6.out0, IN[1]=filterByBoolMask.out)  # CPython3; graph output
# ---------- VALIDATE_PK_WITH_CORRIDOR.python (228 lines) ----------
# CPython3 - VALIDATE_PK_WITH_CORRIDOR
# Validates whether each sign station is within the selected corridor range.
#
# IN[0] = Excel data passed through BlockDirectory
# IN[1] = Corridor FeatureLine
#
# OUT[0] = Valid rows
# OUT[1] = Invalid rows
# OUT[2] = Validation errors

import re

data = IN[0]
feature_input = IN[1]


# ============================================================
# AUXILIARY FUNCTIONS
# ============================================================

def first_valid_featureline(obj):
    """
    Returns the first valid CorridorFeatureLine found in a nested input.
    """
    if obj is None:
        return None

    if isinstance(obj, (list, tuple)):
        for item in obj:
            result = first_valid_featureline(item)

            if result is not None:
                return result

        return None

    return obj


def is_empty_row(row):
    """
    Checks whether an imported Excel row is empty.
    """
    if row is None:
        return True

    if not isinstance(row, (list, tuple)):
        return True

    return all(
        value is None or str(value).strip() == ""
        for value in row
    )


def to_number(value):
    """
    Converts Excel numbers or station labels into float values.
    Examples:
        6351.00  -> 6351.0
        6+351.00 -> 6351.0
        6351,00  -> 6351.0
    """
    if value is None:
        return None

    if isinstance(value, (int, float)):
        return float(value)

    text = str(value).strip().replace(" ", "")

    if text == "":
        return None

    if "+" in text:
        text = text.replace("+", "")

    if "," in text and "." not in text:
        text = text.replace(",", ".")

    text = re.sub(r"[^0-9.\-]", "", text)

    try:
        return float(text)

    except Exception:
        return None


# ============================================================
# INITIALIZATION
# ============================================================

feature_line = first_valid_featureline(feature_input)

valid_rows = []
invalid_rows = []
errors = []


# ============================================================
# VALIDATION
# ============================================================

if feature_line is None:

    OUT = (
        [],
        data if data is not None else [],
        ["No valid CorridorFeatureLine was received."]
    )

else:

    if data is None:
        data = []

    for index, row in enumerate(data):

        excel_row_number = index + 2

        if is_empty_row(row):
            continue

        # Current SIGNS worksheet contains 22 columns
        if not isinstance(row, (list, tuple)) or len(row) < 22:

            invalid_rows.append(row)

            errors.append(
                "Row {}: Incomplete data structure. "
                "The current SIGNS worksheet requires 22 columns."
                .format(excel_row_number)
            )

            continue

        # ----------------------------------------------------
        # CURRENT SIGNS COLUMN ORDER
        # ----------------------------------------------------

        element_id = row[0]
        block_name = row[1]
        side = row[2]
        pk_value = to_number(row[3])
        pk_label = row[4]

        # ----------------------------------------------------
        # VALIDATE PK VALUE
        # ----------------------------------------------------

        if pk_value is None:

            # Optional fallback using PKLabel
            pk_value = to_number(pk_label)

        if pk_value is None:

            invalid_rows.append(row)

            errors.append(
                "Row {} | ID: {} | Invalid PKValue and PKLabel."
                .format(
                    excel_row_number,
                    element_id
                )
            )

            continue

        # ----------------------------------------------------
        # CHECK STATION AGAINST THE CORRIDOR FEATURE LINE
        # ----------------------------------------------------

        try:

            test_result = feature_line.OffsetElevationByStation(
                pk_value
            )

            if test_result is None:

                invalid_rows.append(row)

                errors.append(
                    "Row {} | ID: {} | Block: {} | Side: {} | "
                    "PK: {} / {} is outside the corridor range."
                    .format(
                        excel_row_number,
                        element_id,
                        block_name,
                        side,
                        pk_label,
                        pk_value
                    )
                )

            else:

                valid_rows.append(row)

        except Exception as error:

            invalid_rows.append(row)

            errors.append(
                "Row {} | ID: {} | Block: {} | PK: {} / {} "
                "could not be validated. Details: {}"
                .format(
                    excel_row_number,
                    element_id,
                    block_name,
                    pk_label,
                    pk_value,
                    str(error)
                )
            )


# ============================================================
# OUTPUTS
# ============================================================

OUT = (
    valid_rows,      # 0 - Valid Excel rows
    invalid_rows,    # 1 - Invalid Excel rows
    errors           # 2 - Validation messages
)
# ----------------------------------------
code_block_7 = CodeBlock(valid=VALIDATE_PK_WITH_CORRIDOR) { valid[0]; valid[2]; }
LEFT = Python(IN[0]=code_block_7.out0)  # CPython3
# ---------- LEFT.python (210 lines) ----------
# CPython3 - Dynamo / Civil 3D
import re

data = IN[0]
SIDE_TARGET = "LEFT"  # Cambiar a "LEFT" en el nodo del lado izquierdo


def to_number(value):
    """Convierte valores numéricos o textos de Excel a float."""
    if value is None:
        return None

    if isinstance(value, (int, float)):
        return float(value)

    text = str(value).strip().replace(" ", "")

    if text == "":
        return None

    # Permite leer PK escritos como 6+351.00
    if "+" in text:
        text = text.replace("+", "")

    # Convierte coma decimal a punto
    if "," in text and "." not in text:
        text = text.replace(",", ".")

    text = re.sub(r"[^0-9.\-]", "", text)

    try:
        return float(text)
    except Exception:
        return None


def norm_side(value):
    """Normaliza diferentes formas de escribir LEFT y RIGHT."""
    text = str(value).strip().upper()

    if text in ["RIGHT", "R", "DERECHA", "DER", "D"]:
        return "RIGHT"

    if text in ["LEFT", "L", "IZQUIERDA", "IZQ", "I"]:
        return "LEFT"

    return text


# ============================================================
# LISTAS DE SALIDA EN EL MISMO ORDEN DE LA HOJA SIGNS
# ============================================================

ids = []             # 0
blocknames = []      # 1
sides = []           # 2
pkvalues = []        # 3
pklabels = []        # 4
offsets = []         # 5
heights = []         # 6
eyeheights = []      # 7
notes = []           # 8
materials = []       # 9
rotationmodes = []   # 10
layers = []          # 11
dwgnames = []        # 12
signcodes = []       # 13
ifcentities = []     # 14
categories = []      # 15
normatives = []      # 16
descriptions = []    # 17
quantities = []      # 18
unittimes = []       # 19
unitcosts = []       # 20
totalcosts = []      # 21

warnings = []        # 22


# ============================================================
# LECTURA Y FILTRADO DE FILAS
# ============================================================

for idx, row in enumerate(data):
    excel_row = idx + 2

    try:
        # La estructura actual requiere al menos 22 columnas
        if row is None or len(row) < 22:
            continue

        element_id = row[0]
        blockname = row[1]
        side = norm_side(row[2])
        pkvalue = to_number(row[3])
        pklabel = row[4]
        offset = to_number(row[5])
        height = to_number(row[6])
        eyeheight = to_number(row[7])
        note = row[8]
        material = row[9]
        rotationmode = row[10]
        layer = row[11]
        dwgname = row[12]
        signcode = row[13]
        ifcentity = row[14]
        category = row[15]
        normative = row[16]
        description = row[17]
        quantity = to_number(row[18])
        unittime = to_number(row[19])
        unitcost = to_number(row[20])
        totalcost = to_number(row[21])

        # Ignorar filas sin bloque seleccionado
        if blockname is None or str(blockname).strip() == "":
            continue

        # Separar señales según el lado
        if side != SIDE_TARGET:
            continue

        # PKValue es el dato utilizado para la geometría
        if pkvalue is None:
            pkvalue = to_number(pklabel)

        if pkvalue is None:
            warnings.append(
                "Fila {}: PKValue/PKLabel inválido.".format(excel_row)
            )
            continue

        if offset is None:
            warnings.append(
                "Fila {}: Offset inválido.".format(excel_row)
            )
            continue

        # Valores predeterminados
        if quantity is None:
            quantity = 1.0

        if unittime is None:
            unittime = 0.0

        if unitcost is None:
            unitcost = 0.0

        if totalcost is None:
            totalcost = quantity * unitcost

        # Agregar datos conservando el orden de SIGNS
        ids.append(element_id)
        blocknames.append(blockname)
        sides.append(side)
        pkvalues.append(pkvalue)
        pklabels.append(pklabel)
        offsets.append(offset)
        heights.append(height)
        eyeheights.append(eyeheight)
        notes.append(note)
        materials.append(material)
        rotationmodes.append(rotationmode)
        layers.append(layer)
        dwgnames.append(dwgname)
        signcodes.append(signcode)
        ifcentities.append(ifcentity)
        categories.append(category)
        normatives.append(normative)
        descriptions.append(description)
        quantities.append(quantity)
        unittimes.append(unittime)
        unitcosts.append(unitcost)
        totalcosts.append(totalcost)

    except Exception as error:
        warnings.append(
            "Fila {}: {}".format(excel_row, str(error))
        )


# ============================================================
# SALIDAS
# ============================================================

OUT = (
    ids,             # 0  ID
    blocknames,      # 1  BlockName
    sides,           # 2  Side
    pkvalues,        # 3  PKValue / Station
    pklabels,        # 4  PKLabel
    offsets,         # 5  Offset
    heights,         # 6  Height
    eyeheights,      # 7  EyeHeight
    notes,           # 8  Notes
    materials,       # 9  Material
    rotationmodes,   # 10 RotationMode
    layers,          # 11 Layer
    dwgnames,        # 12 DWGName
    signcodes,       # 13 SignCode
    ifcentities,     # 14 IFCEntity
    categories,      # 15 Category
    normatives,      # 16 Normative
    descriptions,   # 17 Description
    quantities,      # 18 Quantity
    unittimes,       # 19 UnitTime
    unitcosts,       # 20 UnitCost
    totalcosts,      # 21 TotalCost
    warnings         # 22 Warnings
)
# ----------------------------------------
code_block_8 = CodeBlock(left=LEFT)
# ---------- code_block_8.designscript (22 lines) ----------
left[0];
left[1];
left[2];
left[3];
left[4];
left[5];
left[6];
left[7];
left[8];
left[9];
left[10];
left[11];
left[12];
left[13];
left[14];
left[15];
left[16];
left[17];
left[18];
left[19];
left[20];
left[21];
# ----------------------------------------
RIGHT = Python(IN[0]=code_block_7.out0)  # CPython3
# ---------- RIGHT.python (210 lines) ----------
# CPython3 - Dynamo / Civil 3D
import re

data = IN[0]
SIDE_TARGET = "RIGHT"  # Cambiar a "LEFT" en el nodo del lado izquierdo


def to_number(value):
    """Convierte valores numéricos o textos de Excel a float."""
    if value is None:
        return None

    if isinstance(value, (int, float)):
        return float(value)

    text = str(value).strip().replace(" ", "")

    if text == "":
        return None

    # Permite leer PK escritos como 6+351.00
    if "+" in text:
        text = text.replace("+", "")

    # Convierte coma decimal a punto
    if "," in text and "." not in text:
        text = text.replace(",", ".")

    text = re.sub(r"[^0-9.\-]", "", text)

    try:
        return float(text)
    except Exception:
        return None


def norm_side(value):
    """Normaliza diferentes formas de escribir LEFT y RIGHT."""
    text = str(value).strip().upper()

    if text in ["RIGHT", "R", "DERECHA", "DER", "D"]:
        return "RIGHT"

    if text in ["LEFT", "L", "IZQUIERDA", "IZQ", "I"]:
        return "LEFT"

    return text


# ============================================================
# LISTAS DE SALIDA EN EL MISMO ORDEN DE LA HOJA SIGNS
# ============================================================

ids = []             # 0
blocknames = []      # 1
sides = []           # 2
pkvalues = []        # 3
pklabels = []        # 4
offsets = []         # 5
heights = []         # 6
eyeheights = []      # 7
notes = []           # 8
materials = []       # 9
rotationmodes = []   # 10
layers = []          # 11
dwgnames = []        # 12
signcodes = []       # 13
ifcentities = []     # 14
categories = []      # 15
normatives = []      # 16
descriptions = []    # 17
quantities = []      # 18
unittimes = []       # 19
unitcosts = []       # 20
totalcosts = []      # 21

warnings = []        # 22


# ============================================================
# LECTURA Y FILTRADO DE FILAS
# ============================================================

for idx, row in enumerate(data):
    excel_row = idx + 2

    try:
        # La estructura actual requiere al menos 22 columnas
        if row is None or len(row) < 22:
            continue

        element_id = row[0]
        blockname = row[1]
        side = norm_side(row[2])
        pkvalue = to_number(row[3])
        pklabel = row[4]
        offset = to_number(row[5])
        height = to_number(row[6])
        eyeheight = to_number(row[7])
        note = row[8]
        material = row[9]
        rotationmode = row[10]
        layer = row[11]
        dwgname = row[12]
        signcode = row[13]
        ifcentity = row[14]
        category = row[15]
        normative = row[16]
        description = row[17]
        quantity = to_number(row[18])
        unittime = to_number(row[19])
        unitcost = to_number(row[20])
        totalcost = to_number(row[21])

        # Ignorar filas sin bloque seleccionado
        if blockname is None or str(blockname).strip() == "":
            continue

        # Separar señales según el lado
        if side != SIDE_TARGET:
            continue

        # PKValue es el dato utilizado para la geometría
        if pkvalue is None:
            pkvalue = to_number(pklabel)

        if pkvalue is None:
            warnings.append(
                "Fila {}: PKValue/PKLabel inválido.".format(excel_row)
            )
            continue

        if offset is None:
            warnings.append(
                "Fila {}: Offset inválido.".format(excel_row)
            )
            continue

        # Valores predeterminados
        if quantity is None:
            quantity = 1.0

        if unittime is None:
            unittime = 0.0

        if unitcost is None:
            unitcost = 0.0

        if totalcost is None:
            totalcost = quantity * unitcost

        # Agregar datos conservando el orden de SIGNS
        ids.append(element_id)
        blocknames.append(blockname)
        sides.append(side)
        pkvalues.append(pkvalue)
        pklabels.append(pklabel)
        offsets.append(offset)
        heights.append(height)
        eyeheights.append(eyeheight)
        notes.append(note)
        materials.append(material)
        rotationmodes.append(rotationmode)
        layers.append(layer)
        dwgnames.append(dwgname)
        signcodes.append(signcode)
        ifcentities.append(ifcentity)
        categories.append(category)
        normatives.append(normative)
        descriptions.append(description)
        quantities.append(quantity)
        unittimes.append(unittime)
        unitcosts.append(unitcost)
        totalcosts.append(totalcost)

    except Exception as error:
        warnings.append(
            "Fila {}: {}".format(excel_row, str(error))
        )


# ============================================================
# SALIDAS
# ============================================================

OUT = (
    ids,             # 0  ID
    blocknames,      # 1  BlockName
    sides,           # 2  Side
    pkvalues,        # 3  PKValue / Station
    pklabels,        # 4  PKLabel
    offsets,         # 5  Offset
    heights,         # 6  Height
    eyeheights,      # 7  EyeHeight
    notes,           # 8  Notes
    materials,       # 9  Material
    rotationmodes,   # 10 RotationMode
    layers,          # 11 Layer
    dwgnames,        # 12 DWGName
    signcodes,       # 13 SignCode
    ifcentities,     # 14 IFCEntity
    categories,      # 15 Category
    normatives,      # 16 Normative
    descriptions,   # 17 Description
    quantities,      # 18 Quantity
    unittimes,       # 19 UnitTime
    unitcosts,       # 20 UnitCost
    totalcosts,      # 21 TotalCost
    warnings         # 22 Warnings
)
# ----------------------------------------
code_block_9 = CodeBlock(right=RIGHT)
# ---------- code_block_9.designscript (22 lines) ----------
right[0];
right[1];
right[2];
right[3];
right[4];
right[5];
right[6];
right[7];
right[8];
right[9];
right[10];
right[11];
right[12];
right[13];
right[14];
right[15];
right[16];
right[17];
right[18];
right[19];
right[20];
right[21];
# ----------------------------------------
watch = Watch(code_block_6.out1)

# group: RIGHT SIDE COORDINATES
alignment = Autodesk.Civil.DynamoNodes.Baseline.Alignment(baseline=baselines)
firstItem = List.FirstItem(list=alignment)
selectCodeOffset = Python(IN[0]=filterByBoolMask.in, IN[1]=code_block_9.out3, IN[2]=code_block_9.out5)  # CPython3
# ---------- selectCodeOffset.python (210 lines) ----------
# CPython3 - Diagnose and select outermost ETW/EPS feature line
#
# IN[0] = Corridor Feature Lines for one side
# IN[1] = Stations (PKValue)
# IN[2] = Excel offsets measured outward from the pavement edge
#
# OUT[0] = Selected reference offsets
# OUT[1] = Selected elevations
# OUT[2] = Final offsets from baseline alignment
# OUT[3] = Diagnostic candidates
# OUT[4] = Warnings

feature_lines_input = IN[0]
stations_input = IN[1]
excel_offsets_input = IN[2]


def as_list(value):
    if value is None:
        return []

    if isinstance(value, (list, tuple)):
        result = []

        for item in value:
            if isinstance(item, (list, tuple)):
                result.extend(as_list(item))
            else:
                result.append(item)

        return result

    return [value]


def to_number(value):
    if value is None:
        return None

    if isinstance(value, (int, float)):
        return float(value)

    text = str(value).strip().replace(" ", "")

    if text == "":
        return None

    if "+" in text:
        text = text.replace("+", "")

    if "," in text and "." not in text:
        text = text.replace(",", ".")

    try:
        return float(text)
    except Exception:
        return None


def get_value(result, key):
    if result is None:
        return None

    try:
        if isinstance(result, dict):
            return result.get(key)

        if hasattr(result, "ValueAtKey"):
            return result.ValueAtKey(key)

        return result[key]

    except Exception:
        return None


def object_label(obj):
    """Returns a readable label for diagnostic purposes."""
    if obj is None:
        return "None"

    try:
        return str(obj)
    except Exception:
        return obj.GetType().Name


feature_lines = as_list(feature_lines_input)
stations = as_list(stations_input)
excel_offsets = as_list(excel_offsets_input)

selected_reference_offsets = []
selected_elevations = []
final_offsets = []
diagnostics = []
warnings = []


for index, station_value in enumerate(stations):

    station = to_number(station_value)

    excel_offset = (
        to_number(excel_offsets[index])
        if index < len(excel_offsets)
        else 0.0
    )

    if excel_offset is None:
        excel_offset = 0.0

    if station is None:
        selected_reference_offsets.append(None)
        selected_elevations.append(None)
        final_offsets.append(None)
        diagnostics.append([])

        warnings.append(
            "Item {}: invalid station value.".format(index)
        )
        continue

    candidates = []
    item_diagnostics = []

    for line_index, feature_line in enumerate(feature_lines):

        if feature_line is None:
            continue

        try:
            result = feature_line.OffsetElevationByStation(station)

            offset = to_number(
                get_value(result, "Offset")
            )

            elevation = to_number(
                get_value(result, "Elevation")
            )

            item_diagnostics.append({
                "LineIndex": line_index,
                "FeatureLine": object_label(feature_line),
                "Station": station,
                "Offset": offset,
                "Elevation": elevation
            })

            if offset is not None and elevation is not None:
                candidates.append(
                    (
                        abs(offset),
                        offset,
                        elevation,
                        line_index,
                        object_label(feature_line)
                    )
                )

        except Exception as error:
            item_diagnostics.append({
                "LineIndex": line_index,
                "FeatureLine": object_label(feature_line),
                "Station": station,
                "Error": str(error)
            })

    diagnostics.append(item_diagnostics)

    if len(candidates) == 0:
        selected_reference_offsets.append(None)
        selected_elevations.append(None)
        final_offsets.append(None)

        warnings.append(
            "Item {}: no valid ETW or EPS feature line "
            "was found at station {}."
            .format(index, station)
        )
        continue

    # Largest absolute lateral offset
    selected = max(
        candidates,
        key=lambda item: item[0]
    )

    reference_offset = selected[1]
    elevation = selected[2]

    direction = 1.0 if reference_offset >= 0 else -1.0

    final_offset = (
        reference_offset
        + direction * abs(excel_offset)
    )

    selected_reference_offsets.append(reference_offset)
    selected_elevations.append(elevation)
    final_offsets.append(final_offset)


OUT = (
    selected_reference_offsets,  # 0
    selected_elevations,         # 1
    final_offsets,               # 2
    diagnostics,                 # 3
    warnings                     # 4
)
# ----------------------------------------
code_block_10 = CodeBlock(sel=selectCodeOffset) { sel[0]; sel[1]; sel[2]; sel[3]; }
coordinateSystemByStationOffset = Autodesk.Civil.DynamoNodes.Alignment.CoordinateSystemByStationOffset(alignment=firstItem, station=code_block_9.out3@L1, offset=code_block_10.out2@L1)
origin = CoordinateSystem.Origin(coordinateSystem=coordinateSystemByStationOffset)
code_block_11 = CodeBlock(Pd=origin) { Pd.X; Pd.Y; }
byCoordinates = Point.ByCoordinates(x=code_block_11.out0, y=code_block_11.out1, z=code_block_10.out1)
watch_2 = Watch(code_block_10.out2)
watch_3 = Watch(alignment)

# group: SIGN ROTATE ORTHO TO LANE (RIGHT)
XAxis = Vector.XAxis()
YAxis = CoordinateSystem.YAxis(coordinateSystem=coordinateSystemByStationOffset)
ZAxis = Vector.ZAxis()
angleAboutAxis = Vector.AngleAboutAxis(vector=XAxis, otherVector=YAxis, rotationAxis=ZAxis)
code_block_12 = CodeBlock(angle=angleAboutAxis) { angle + -90; }

# group: LEFT SIDE COORDINATES
selectCodeOffset_2 = Python(IN[0]=filterByBoolMask.out, IN[1]=code_block_8.out3, IN[2]=code_block_8.out5)  # CPython3; same code as selectCodeOffset
code_block_13 = CodeBlock(sel=selectCodeOffset_2) { sel[0]; sel[1]; sel[2]; sel[3]; }
coordinateSystemByStationOffset_2 = Autodesk.Civil.DynamoNodes.Alignment.CoordinateSystemByStationOffset(alignment=alignment, station=code_block_8.out3@L1, offset=code_block_13.out2@L1)
origin_2 = CoordinateSystem.Origin(coordinateSystem=coordinateSystemByStationOffset_2)
code_block_14 = CodeBlock(Pd=origin_2) { Pd.X; Pd.Y; }
byCoordinates_2 = Point.ByCoordinates(x=code_block_14.out0, y=code_block_14.out1, z=code_block_13.out1)
watch_4 = Watch(coordinateSystemByStationOffset_2)

# group: SIGN ROTATE ORTHO TO LANE (LEFT)
XAxis_2 = Vector.XAxis()
YAxis_2 = CoordinateSystem.YAxis(coordinateSystem=coordinateSystemByStationOffset_2)
ZAxis_2 = Vector.ZAxis()
angleAboutAxis_2 = Vector.AngleAboutAxis(vector=XAxis_2, otherVector=YAxis_2, rotationAxis=ZAxis_2)
code_block_15 = CodeBlock(angle=angleAboutAxis_2) { angle + 90; }

# group: MAKE MODEL BLOCK
current = Autodesk.AutoCAD.DynamoNodes.Document.Current()
blockByName = Autodesk.AutoCAD.DynamoNodes.Block.GetBlockByName(document=current, blockName=code_block_9.out1)  # "Document.BlockByName"
flatten_2 = List.Flatten(list=blockByName)
code_block_16 = CodeBlock { 1; "C-SIGN"; Vector.ZAxis(); }
modelSpace = Autodesk.AutoCAD.DynamoNodes.Document.ModelSpace(document=current)
byPoint = Autodesk.AutoCAD.DynamoNodes.BlockReference.ByPoint(sourceBlock=flatten_2, insertionPoint=byCoordinates, rotation=code_block_12, scale=code_block_16.out0, normal=code_block_16.out2, layerName=code_block_16.out1, block=modelSpace)
blockByName_2 = Autodesk.AutoCAD.DynamoNodes.Block.GetBlockByName(document=current, blockName=code_block_8.out1)  # "Document.BlockByName"
flatten_3 = List.Flatten(list=blockByName_2)
byPoint_2 = Autodesk.AutoCAD.DynamoNodes.BlockReference.ByPoint(sourceBlock=flatten_3, insertionPoint=byCoordinates_2, rotation=code_block_15, scale=code_block_16.out0, normal=code_block_16.out2, layerName=code_block_16.out1, block=modelSpace)

# group: EXCEL PROPERTIES TO BLOCK SET
leftSide = FromObject(object=code_block_8.out0)
code_block_17 = CodeBlock()
# ---------- code_block_17.designscript (3 lines) ----------
// Nombre de Conjunto
"PSET_SIGNS";
// Campos de Propiedad
# ----------------------------------------
code_block_18 = CodeBlock(bloq_derecha=byPoint, Conjunto=code_block_17, bloq_izquierda=byPoint_2)
# ---------- code_block_18.designscript (5 lines) ----------
/*
AGREGAR CONJUNTO DE DATOS A BLOQUES DE SALIDA
*/
obj_derecha = CivilObject.AddPropertySet(bloq_derecha,Conjunto);
obj_izquierda = CivilObject.AddPropertySet(bloq_izquierda,Conjunto);
# ----------------------------------------
code_block_19 = CodeBlock(obj_der=code_block_18.obj_derecha, conjunto=code_block_17, id_d=code_block_9.out0, blockname_d=code_block_9.out1, side_d=code_block_9.out2, pkvalue_d=code_block_9.out3, pklabel_d=code_block_9.out4, offset_d=code_block_9.out5, height_d=code_block_9.out6, eyeheight_d=code_block_9.out7, notes_d=code_block_9.out8, material_d=code_block_9.out9, rotationmode_d=code_block_9.out10, layer_d=code_block_9.out11, dwgname_d=code_block_9.out12, signcode_d=code_block_9.out13, ifcentity_d=code_block_9.out14, category_d=code_block_9.out15, normative_d=code_block_9.out16, description_d=code_block_9.out17, quantity_d=code_block_9.out18, unittime_d=code_block_9.out19, unitcost_d=code_block_9.out20, totalcost_d=code_block_9.out21, coordx_d=code_block_11.out0, coordy_d=code_block_11.out1, coordz_d=code_block_10.out1, elevation_d=code_block_10.out1, alignment_d=alignment, obj_izq=code_block_18.obj_izquierda, id_i=code_block_8.out0, blockname_i=code_block_8.out1, side_i=code_block_8.out2, pkvalue_i=code_block_8.out3, pklabel_i=code_block_8.out4, offset_i=code_block_8.out5, height_i=code_block_8.out6, eyeheight_i=code_block_8.out7, notes_i=code_block_8.out8, material_i=code_block_8.out9, rotationmode_i=code_block_8.out10, layer_i=code_block_8.out11, dwgname_i=code_block_8.out12, signcode_i=code_block_8.out13, ifcentity_i=code_block_8.out14, category_i=code_block_8.out15, normative_i=code_block_8.out16, description_i=code_block_8.out17, quantity_i=code_block_8.out18, unittime_i=code_block_8.out19, unitcost_i=code_block_8.out20, totalcost_i=code_block_8.out21, coordx_i=code_block_14.out0, coordy_i=code_block_14.out1, coordz_i=code_block_13.out1, elevation_i=code_block_13.out1, alignment_i=alignment)
# ---------- code_block_19.designscript (69 lines) ----------
/*
FUNCION PARA AÑADIR PROPIEDADES
*/
def setProp(obj, pset, prop, val)
{
    return = CivilObject.UpdateProperty(obj, pset, prop, val);
};

// DERECHA
d01 = setProp(obj_der, conjunto, "ID", id_d);
d02 = setProp(obj_der, conjunto, "Block", blockname_d);
d03 = setProp(obj_der, conjunto, "Side", side_d);
d04 = setProp(obj_der, conjunto, "PKValue", pkvalue_d);
d05 = setProp(obj_der, conjunto, "PKLabel", pklabel_d);
d06 = setProp(obj_der, conjunto, "Offset", offset_d);
d07 = setProp(obj_der, conjunto, "Height", height_d);
d08 = setProp(obj_der, conjunto, "EyeHeight", eyeheight_d);
d09 = setProp(obj_der, conjunto, "Notes", notes_d);
d10 = setProp(obj_der, conjunto, "Material", material_d);
d11 = setProp(obj_der, conjunto, "RotationMode", rotationmode_d);
d12 = setProp(obj_der, conjunto, "Layer", layer_d);
d13 = setProp(obj_der, conjunto, "DWGName", dwgname_d);
d14 = setProp(obj_der, conjunto, "SignalCode", signcode_d);
d15 = setProp(obj_der, conjunto, "IFCEntity", ifcentity_d);
d16 = setProp(obj_der, conjunto, "Category", category_d);
d17 = setProp(obj_der, conjunto, "Normative", normative_d);
d18 = setProp(obj_der, conjunto, "Description", description_d);
d19 = setProp(obj_der, conjunto, "Quantity", quantity_d);
d20 = setProp(obj_der, conjunto, "TimeUnit(h)", unittime_d);
d21 = setProp(obj_der, conjunto, "CostUnit", unitcost_d);
d22 = setProp(obj_der, conjunto, "TotalCost", totalcost_d);


d23 = setProp(obj_der, conjunto, "CoordinateX", coordx_d);
d24 = setProp(obj_der, conjunto, "CoordinateY", coordy_d);
d25 = setProp(obj_der, conjunto, "CoordinateZ", coordz_d);
d26 = setProp(obj_der, conjunto, "Elevation", elevation_d);
d27 = setProp(obj_der, conjunto, "Alignment", alignment_d);

// IZQUIERDA
i01 = setProp(obj_izq, conjunto, "ID", id_i);
i02 = setProp(obj_izq, conjunto, "Block", blockname_i);
i03 = setProp(obj_izq, conjunto, "Side", side_i);
i04 = setProp(obj_izq, conjunto, "PKValue", pkvalue_i);
i05 = setProp(obj_izq, conjunto, "PKLabel", pklabel_i);
i06 = setProp(obj_izq, conjunto, "Offset", offset_i);
i07 = setProp(obj_izq, conjunto, "Height", height_i);
i08 = setProp(obj_izq, conjunto, "EyeHeight", eyeheight_i);
i09 = setProp(obj_izq, conjunto, "Notes", notes_i);
i10 = setProp(obj_izq, conjunto, "Material", material_i);
i11 = setProp(obj_izq, conjunto, "RotationMode", rotationmode_i);
i12 = setProp(obj_izq, conjunto, "Layer", layer_i);
i13 = setProp(obj_izq, conjunto, "DWGName", dwgname_i);
i14 = setProp(obj_izq, conjunto, "SignalCode", signcode_i);
i15 = setProp(obj_izq, conjunto, "IFCEntity", ifcentity_i);
i16 = setProp(obj_izq, conjunto, "Category", category_i);
i17 = setProp(obj_izq, conjunto, "Normative", normative_i);
i18 = setProp(obj_izq, conjunto, "Description", description_i);
i19 = setProp(obj_izq, conjunto, "Quantity", quantity_i);
i20 = setProp(obj_izq, conjunto, "TimeUnit(h)", unittime_i);
i21 = setProp(obj_izq, conjunto, "CostUnit", unitcost_i);
i22 = setProp(obj_izq, conjunto, "TotalCost", totalcost_i);


i23 = setProp(obj_izq, conjunto, "CoordinateX", coordx_i);
i24 = setProp(obj_izq, conjunto, "CoordinateY", coordy_i);
i25 = setProp(obj_izq, conjunto, "CoordinateZ", coordz_i);
i26 = setProp(obj_izq, conjunto, "Elevation", elevation_i);
i27 = setProp(obj_izq, conjunto, "Alignment", alignment_i);
# ----------------------------------------
rightSide = FromObject(object=code_block_9.out0)
string_from_object = FromObject(object=corridors)

watch_5 = Watch(code_block_13.out2)
watch_6 = Watch(code_block_13.out3)
watch_7 = Watch(code_block_9.out3)
